# Grasshopper definition Arch Study.gh (Grasshopper 1.0.7)
# plug-ins: MeshEdit Components, Weaverbird, Kangaroo2 Components, Human

# ---- group: 6M2 Rectangle by Rectangle!
# Maximium Pavilion Dimensions
xy = XYPlane(Origin=Point(0, 0, 0))
rectangle = Rectangle(Plane=xy, XSize="0 to 6000", YSize="0 to 6000", Radius=0)  # -> Rectangle, Length

# ---- group: Max Height
move = Move(Geometry=rectangle.Rectangle, Motion="0,0,6000")  # -> Geometry, Transform

# ----
mesh = Mesh([<mesh referenced from the Rhino model> x163])

# ---- group: Spacing in X
arrlinear = LinearArray(Geometry=rectangle.Rectangle, Direction="10000,0,0", Count="1")  # -> Geometry, Transform

# ----
mjoin = MeshJoin(Meshes=mesh)
weldvertices = MeshWeldVertices(Mesh=mjoin, Tolerance=0.01)  # -> RuntimeMessage, Mesh
wbcatmullclark = WeaverbirdsCatmullClarkSubdivision(MeshCurves=weldvertices.Mesh, Level=Slider(3, range=1..3), SmoothNakedEdges=Slider(1, range=0..2))
mesh_2 = Mesh(wbcatmullclark)

edgelengths = EdgeLengths(Mesh=mesh_2, LengthFactor=Slider(1, range=0..1), Strength="10")

demesh = DeconstructMesh()  # -> Vertices, Faces, Colours, Normals
Z = UnitZ(Factor=1)
load = Load(Point=demesh.Vertices, ForceVector=Z, Weighting=Slider(0.098, range=0..1))

pt = Point()
anchor = Anchor(Point=pt, Strength=10000)

show = Show(G=mesh_2)
merge = Merge(Data1=edgelengths, Data2=show)  # -> flatten(Result)

zombiesolver = ZombieSolver(GoalObjects=merge, Threshold=Slider(1e-05, range=0..1e-05), Tolerance=0.0001, MaxIterations=50000)  # -> I, V, O
clean = CleanTree(RemoveNulls=True, RemoveInvalid=True, RemoveEmpty=False, Tree=zombiesolver.O)
item = ListItem(List=clean, Index=0, Wrap=True)

# ----
# Spacing in Y
number_slider = Slider(10000, range=0..10000)
Y = UnitY(Factor=number_slider)
move_2 = Move(Geometry=item, Motion=Y)  # -> Geometry, Transform
mesh_3 = Mesh(move_2.Geometry)
X = UnitX(Factor=Slider(20000, range=0..20000))
X_2 = UnitX(Factor=Slider(10000, range=0..10000))
X_3 = UnitX(Factor=Slider(20000, range=0..20000))
move_3 = Move(Geometry=mesh, Motion=X)  # -> Geometry, Transform
move_4 = Move(Geometry=mesh_3, Motion=X_2)  # -> Geometry, Transform
move_5 = Move(Geometry=mesh_3, Motion=X_3)  # -> Geometry, Transform
mesh_4 = Mesh(move_3.Geometry)
mesh_5 = Mesh(move_5.Geometry)

# ---- group: Chosen Face(s)
panel = Panel("5")

# ----
stripper = Stripper(Mesh=move_4.Geometry)
dispatch = Dispatch(List=stripper, DispatchPattern=[True, False])  # -> ListA, ListB
preview = CustomPreview(Geometry=dispatch.ListB, Shader=ColourSwatch(SwatchColor=RGB(255, 255, 255)))
preview_2 = CustomPreview(Geometry=dispatch.ListA, Shader=ColourSwatch(SwatchColor=RGB(0, 0, 0)))

stripper_2 = Stripper(Mesh=move_5.Geometry)
dispatch_2 = Dispatch(List=stripper_2, DispatchPattern=[True, False])  # -> ListA, ListB
preview_3 = CustomPreview(Geometry=dispatch_2.ListB, Shader=ColourSwatch(SwatchColor=RGB(255, 255, 255)))
preview_4 = CustomPreview(Geometry=dispatch_2.ListA, Shader=ColourSwatch(SwatchColor=RGB(0, 0, 0)))

# ---- group: WARP & WEFT
warpweft = WarpWeft(Mesh=move_4.Geometry)  # -> Warp, Weft, NakedA, NakedB
previewlw = CustomPreviewLineweights(Geometry=warpweft.Warp, Shader=ColourSwatch(SwatchColor=RGB(0, 0, 0)), Absolute=False)
previewlw_2 = CustomPreviewLineweights(Geometry=warpweft.Weft, Shader=ColourSwatch(SwatchColor=RGB(0, 139, 255)), Absolute=False)

# ----
mcol = MeshColours(Mesh=move_4.Geometry, Colours=ColourSwatch(SwatchColor=RGB(28, 28, 28)))
preview_5 = CustomPreview(Geometry=mcol, Shader=ColourSwatch(SwatchColor=RGB(255, 255, 255)))

neg = Negative(Value="100")

explode = MeshExplode(Mesh=mesh_4, Interpolate=False)
cull_i = CullIndex(List=explode, Indices=panel, Wrap=True)

# ----
# Vertices Rotation
item_2 = ListItem(List=explode, Index=panel, Wrap=True)
demesh_2 = DeconstructMesh(Mesh=item_2)  # -> Vertices, Faces, Colours, Normals
shift = ShiftList(List=demesh_2.Vertices, Shift=Slider(1, range=0..3), Wrap=True)
conmesh = ConstructMesh(Vertices=shift, Faces=demesh_2.Faces)

merge_2 = Merge(Data1=cull_i, Data2=conmesh)
mjoin_2 = MeshJoin(Meshes=flatten(merge_2))
weldvertices_2 = MeshWeldVertices(Mesh=mjoin_2, Tolerance=0.01)  # -> RuntimeMessage, Mesh

mesh_6 = Mesh(weldvertices_2.Mesh)
facen = FaceNormals(Mesh=mesh_6)  # -> Centers, Normals

# ---- group: Face Numberer
neg_2 = Negative(Value="100")
unit = UnitVector(Vector=facen.Normals)
multiplication = Multiplication(A=unit, B=neg_2)
move_6 = Move(Geometry=facen.Centers, Motion=multiplication)  # -> Geometry, Transform
flatten = FlattenTree(Tree=move_6.Geometry, Path="{0}")
index = ItemIndex(List=flatten, Item=flatten)
tag = TextTag3D(Location=flatten, Text=index, Size="100", Colour=ColourSwatch(SwatchColor=RGB(255, 0, 0)), Justification=5)

# ----
unit_2 = UnitVector(Vector=facen.Normals)
multiplication_2 = Multiplication(A=unit_2, B=neg)

explode_2 = MeshExplode(Mesh=mesh_6, Interpolate=False)
mcol_2 = MeshColours(Mesh=graft(mesh_6), Colours=graft(ColourSwatch(SwatchColor=RGB(224, 224, 224))))
demesh_3 = DeconstructMesh(Mesh=explode_2)  # -> Vertices, Faces, Colours, Normals
avr = Average(Input=demesh_3.Vertices)
preview_6 = CustomPreview(Geometry=mcol_2, Shader=ColourSwatch(SwatchColor=RGB(76, 76, 76)))
scale = Scale(Geometry=demesh_3.Vertices, Center=avr, Factor="0.6")  # -> Geometry, Transform
index_2 = ItemIndex(List=scale.Geometry, Item=scale.Geometry)

move_7 = Move(Geometry=scale.Geometry, Motion=multiplication_2)  # -> Geometry, Transform

tag_2 = TextTag3D(Location=move_7.Geometry, Text=index_2, Size="100", Colour=ColourSwatch(SwatchColor=RGB(0, 0, 0)), Justification=5)
