# Grasshopper definition HoZe Pavilion - 4 Corners Together.gh (Grasshopper 1.0.7)
# plug-ins: MeshEdit Components, Weaverbird, Kangaroo2 Components, Human, Bifocals

# MRAC01
# software I seminar
# inFORMed geometries
# Tutor : Andrea Graziano – Co-de-iT
# Online . 18 Oct. 2021
mesh = Mesh([<mesh referenced from the Rhino model> x362])
turn = MeshTurn(Mesh=mesh)
mjoin = MeshJoin(Meshes=turn)
panel = Panel("24")  # disabled
# Plug-ins:
# Meshedit2000
# Weaverbird
# Human
weldvertices = MeshWeldVertices(Mesh=mjoin, Tolerance=0.01)  # -> RuntimeMessage, Mesh
explode = MeshExplode(Mesh=weldvertices.Mesh, Interpolate=False)
facen = FaceNormals(Mesh=weldvertices.Mesh)  # -> Centers, Normals
cull_i = CullIndex(List=explode, Indices=panel, Wrap=True)
item = ListItem(List=explode, Index=panel, Wrap=True)
wbcatmullclark = WeaverbirdsCatmullClarkSubdivision(MeshCurves=weldvertices.Mesh, Level=Slider(3, range=1..3), SmoothNakedEdges=Slider(1, range=0..2))
points = PointList(Points=facen.Centers, Size=Slider(1.5, range=0..10))
nakededge = MeshNakedEdge(Mesh=wbcatmullclark)  # -> V, A, B
turn_2 = MeshTurn(Mesh=item)
item_2 = ListItem(List=nakededge.V, Index=nakededge.A, Wrap=True)
merge = Merge(Data1=simplify(cull_i), Data2=simplify(turn_2))
mesh_2 = Mesh(wbcatmullclark)
pt = Point(flatten(item_2))
mjoin_2 = MeshJoin(Meshes=flatten(merge))
weldvertices_2 = MeshWeldVertices(Mesh=mjoin_2, Tolerance=0.01)  # -> RuntimeMessage, Mesh

edgelengths = EdgeLengths(Mesh=mesh_2, LengthFactor=Slider(0.5, range=0..1), Strength="10")

demesh = DeconstructMesh(Mesh=mesh_2)  # -> Vertices, Faces, Colours, Normals
Z = UnitZ(Factor=1)
load = Load(Point=demesh.Vertices, ForceVector=Z, Weighting=Slider(0.098, range=0..1))

anchor = Anchor(Point=pt, Strength=10000)
show = Show(G=mesh_2)
merge_2 = Merge(Data3=edgelengths, Data4=anchor, Data5=show)  # -> flatten(Result)

swatch = ColourSwatch(SwatchColor=RGB(214, 214, 214))
swatch_2 = ColourSwatch(SwatchColor=RGB(0, 0, 0))

zombiesolver = ZombieSolver(GoalObjects=merge_2, Threshold=Slider(1e-05, range=0..1e-05), Tolerance=0.0001, MaxIterations=50000)  # -> I, V, O
clean = CleanTree(RemoveNulls=True, RemoveInvalid=True, RemoveEmpty=False, Tree=zombiesolver.O)

move = Move(Geometry=clean, Motion="60,0,0")  # -> Geometry, Transform

item_3 = ListItem(List=move.Geometry, Index=0, Wrap=True)

stripper = Stripper(Mesh=item_3)
lng = ListLength(List=stripper)
wheel = ColourWheel(
    lng,
    ColourGrips_Style=10,
    ColourGrips_Grip=[0.5450988579, 2.094395102, 4.188790205, 3.141592654],
    ColourGrips_Lum=[0.4703921841, 0.7225692612],
    ColourGrips_Range=[1.287044797, 1.287044797, 1.287044797, 1.287044797],
    ColourGrips_Sat=[0.09264315937, 0.9575393383])
medges = MeshEdges(Mesh=stripper)  # -> NakedEdges, InteriorEdges, NonManifoldEdges
mcol = MeshColours(Mesh=graft(stripper), Colours=graft(wheel))
join = JoinCurves(Curves=medges.NakedEdges, Preserve=False)
mjoin_3 = MeshJoin(Meshes=flatten(mcol))
preview = CustomPreview(Geometry=mjoin_3, Shader=ColourSwatch(SwatchColor=RGB(125, 125, 125)))
previewlw = CustomPreviewLineweights(Geometry=join, Shader=swatch_2, Thickness=Slider(0.2, range=0..10), Absolute=Toggle(True))
