# Grasshopper definition HoZe Pavilion Warp and Weft.gh (Grasshopper 1.0.7)
# plug-ins: MeshEdit Components, Weaverbird, Kangaroo2 Components, Bifocals, Human, OpenNest, Heteroptera

# ----
# Stripes Studies
inside_vertical_outside_horizontal = Panel("""66
63
58
86
60
17
24
29
51
82
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""")
checkered = Panel("""49
53
85
52
48
59
64
67
2
22
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""")
horizontal = Panel("""30
7
3
20
23
39
11
56
57
55
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""")
vertical = Panel("""49
53
73
61
85
83
52
46
48
62
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""")

# ----
# Scale Factor
panel = Panel("20")
division = Division(A="6000", B=panel)
panel_2 = Panel(division)

# ----
# Array of Planes
number_slider = Slider(36, range=2..360)
division_2 = Division(A="360", B=number_slider)
xy = XYPlane(Origin=Point(0, 0, 0))
series = Series(Start=0, Step=division_2, Count=number_slider)

# ---- group: 36 Planes
prot = RotatePlane(Plane=xy, Angle=series)

# ----
# Choose Nº of strips
desired_number_of_strips = Slider(2, range=2..6)

# ----
# MRAC01
# inFORMed geometries
# Tutor : Andrea Graziano – Co-de-iT
# Online . 18 Oct. 2021
fixed = Mesh([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])

# ---- group: MeshTurn
# Initial Coarse Mesh
turn = MeshTurn(Mesh=fixed)

# ----
# software I seminar
mjoin = MeshJoin(Meshes=turn)
weldvertices = MeshWeldVertices(Mesh=mjoin, Tolerance=0.01)  # -> RuntimeMessage, Mesh

# ----
# Face Numbers
facen = FaceNormals(Mesh=weldvertices.Mesh)  # -> Centers, Normals
# Plug-ins:
# Meshedit2000
# Weaverbird
# Human
# Output: Completed
#     Coarse Mesh
points = PointList(Points=facen.Centers, Size=Slider(0.5, range=0..10))

# ----
# Stripes Manipulation
explode = MeshExplode(Mesh=weldvertices.Mesh, Interpolate=False)
cull_i = CullIndex(List=explode, Indices=horizontal, Wrap=True)
item = ListItem(List=explode, Index=horizontal, Wrap=True)
turn_2 = MeshTurn(Mesh=item)
merge = Merge(Data1=simplify(cull_i), Data2=simplify(turn_2))
mjoin_2 = MeshJoin(Meshes=flatten(merge))
weldvertices_2 = MeshWeldVertices(Mesh=mjoin_2, Tolerance=0.01)  # -> RuntimeMessage, Mesh

# ----
# Catmull Clark
# Mesh Subdivision
list = ValueList({"One": 1, "Two": 2, "Three": 3}, selected="Three")
list_2 = ValueList({"One": 1, "Two": 2}, selected="One")
wbcatmullclark = WeaverbirdsCatmullClarkSubdivision(MeshCurves=weldvertices_2.Mesh, Level=list, SmoothNakedEdges=list_2)

# ----
# Size before scaling
bbox = BoundingBox(Content=wbcatmullclark, Plane=PlaneXY(0, 0, 0))  # -> Box, Box_2
debox = DeconstructBox(Box=bbox.Box)  # -> Plane, X, Y, Z
panel_3 = Panel(debox.Z)
panel_4 = Panel(debox.X)
panel_5 = Panel(debox.Y)
remap = RemapNumbers(Value=debox.Z, Source=Domain(0, 1), Target=Domain(0, 1))  # -> Mapped, Clipped
remap_2 = RemapNumbers(Value=debox.Y, Source=Domain(0, 1), Target=Domain(0, 1))  # -> Mapped, Clipped
panel_6 = Panel(remap_2.Mapped)
panel_7 = Panel("X = 20")
panel_8 = Panel("Y = 20")
panel_9 = Panel("Z = 12")

remap_3 = RemapNumbers(Value=debox.X, Source=Domain(0, 1), Target=Domain(0, 1))  # -> Mapped, Clipped

nakededge = MeshNakedEdge(Mesh=wbcatmullclark)  # -> V, A, B
item_2 = ListItem(List=nakededge.V, Index=nakededge.A, Wrap=True)
pt = Point(flatten(item_2))

panel_10 = Panel(remap.Mapped)
panel_11 = Panel(remap_3.Mapped)

# ----
# Size after scaling
# Length
# Width
# Height
multiplication = Multiplication(A=panel_10, B=panel_2)
multiplication_2 = Multiplication(A=panel_11, B=panel_2)
multiplication_3 = Multiplication(A=panel_6, B=panel_2)
int = Integer(multiplication)
int_2 = Integer(multiplication_2)
int_3 = Integer(multiplication_3)
x_size_in_mm = Panel(int_2)
y_size_in_mm = Panel(int_3)
z_size_in_mm = Panel(int)

edgelengths = EdgeLengths(Mesh=wbcatmullclark, LengthFactor=Slider(0.5, range=0..1), Strength="10")

demesh = DeconstructMesh(Mesh=wbcatmullclark)  # -> Vertices, Faces, Colours, Normals
Z = UnitZ(Factor=1)
load = Load(Point=demesh.Vertices, ForceVector=Z, Weighting=Slider(0.098, range=0..1))

# ----
# Mesh Relaxation
anchor = Anchor(Point=pt, Strength=10000)
show = Show(G=wbcatmullclark)
merge_2 = Merge(Data3=edgelengths, Data4=anchor, Data5=show)  # -> flatten(Result)

zombiesolver = ZombieSolver(GoalObjects=merge_2, Threshold=Slider(1e-05, range=0..1e-05), Tolerance=0.0001, MaxIterations=50000)  # -> I, V, O
clean = CleanTree(RemoveNulls=True, RemoveInvalid=True, RemoveEmpty=False, Tree=zombiesolver.O)
move = Move(Geometry=clean, Motion="30,0,0")  # -> Geometry, Transform
item_3 = ListItem(List=move.Geometry, Index=0, Wrap=True)

# ----
# Zebra Stripes
stripper = Stripper(Mesh=item_3)
dispatch = Dispatch(List=stripper, DispatchPattern=[True, False])  # -> ListA, ListB
preview = CustomPreview(Geometry=dispatch.ListB, Shader=ColourSwatch(SwatchColor=RGB(0, 0, 0)))
preview_2 = CustomPreview(Geometry=dispatch.ListA, Shader=ColourSwatch(SwatchColor=RGB(255, 255, 255)))

# ---- group: WARP & WEFT
# Warp & Weft
warpweft = WarpWeft(Mesh=item_3)  # -> Warp, Weft, NakedA, NakedB
previewlw = CustomPreviewLineweights(Geometry=warpweft.Warp, Shader=ColourSwatch(SwatchColor=RGB(0, 0, 0)), Absolute=False)
previewlw_2 = CustomPreviewLineweights(Geometry=warpweft.Weft, Shader=ColourSwatch(SwatchColor=RGB(0, 139, 255)), Absolute=False)

# ---- group: Weaverbird's Mesh Edges
# Get Mesh Edges
explode_2 = MeshExplode(Mesh=item_3, Interpolate=False)
wbedges = WeaverbirdsMeshEdges(MeshOrPolylines=graft(explode_2))

# ----
# Get Offset points
number_slider_2 = Slider(0.2, range=0..1)
eval = EvaluateCurve(Curve=reparameterize(wbedges), Parameter=expr("1-x", number_slider_2))  # -> Point, Tangent, Angle
eval_2 = EvaluateCurve(Curve=reparameterize(wbedges), Parameter=number_slider_2)  # -> Point, Tangent, Angle

# ----
# Get Warp & Weft Strips
item_4 = ListItem(List=eval.Point, Index=0, Wrap=True)  # -> Item, Item1, Item2, Item3
item_5 = ListItem(List=eval_2.Point, Index=0, Wrap=True)  # -> Item, Item1, Item2, Item3
pt_2 = Point(item_4.Item1)
pt_3 = Point(item_4.Item2)
pt_4 = Point(item_4.Item3)
pt_5 = Point(item_4.Item)
pt_6 = Point(item_5.Item1)
pt_7 = Point(item_5.Item2)
pt_8 = Point(item_5.Item3)
pt_9 = Point(item_5.Item)
merge_3 = Merge(Data1=pt_6, Data2=pt_2, Data3=pt_4, Data4=pt_8)
merge_4 = Merge(Data1=pt_9, Data2=pt_5, Data3=pt_7, Data4=pt_3)
conmesh = ConstructMesh(Vertices=merge_3, Faces={A=0, B=1, C=2, D=3})
conmesh_2 = ConstructMesh(Vertices=merge_4, Faces={A=0, B=1, C=2, D=3})
merge_5 = Merge(Data1=conmesh_2, Data2=conmesh)
mjoin_3 = MeshJoin(Meshes=flatten(merge_5))
weldvertices_3 = MeshWeldVertices(Mesh=mjoin_3, Tolerance=0.01)  # -> RuntimeMessage, flatten(Mesh)
disjoint = DisjointMesh(Mesh=weldvertices_3.Mesh)
mesh = Mesh(disjoint)

# ----
# Stripe Viewer
number_slider_3 = Slider(0, range=0..407)
item_6 = ListItem(List=disjoint, Index=number_slider_3, Wrap=True)
mesh_2 = Mesh(item_6)

dam = DataDam(DataA=mesh, BufferDelay=10000000, BufferMode=0)
mesh_3 = Mesh(graft(dam))

# ----
# Detect Closed Mesh Strips
# How This Works: An open strip has one single curve making the whole naked edge boundary.
# 
# A closed loop has two curves making the naked boundary.
# 
# We can use this difference to dispatch between open strips and closed loops.
wbnaked = WeaverbirdsNakedBoundary(MeshClosedPolylines=mesh_3)
lng = ListLength(List=wbnaked)
equals = Equality(FirstNumber=lng, SecondNumber="1")  # -> Equality, Inequality
dispatch_2 = Dispatch(List=mesh_3, DispatchPattern=equals.Equality)  # -> ListA, ListB

mesh_4 = Mesh(flatten(dispatch_2.ListA))
Y = UnitY(Factor=1)
multiplication_4 = Multiplication(A=Y, B="52")
move_2 = Move(Geometry=mesh_4, Motion=multiplication_4)  # -> Geometry, Transform
mesh_5 = Mesh(move_2.Geometry)
weldvertices_4 = MeshWeldVertices(Mesh=mesh_5, Tolerance=0.01)  # -> RuntimeMessage, Mesh

# ---- group: Unlooper
rad = Radians(Degrees="0.2")
unloop = UnloopMesh(mesh_loop=dispatch_2.ListB, angle=rad, precision="0.001")

# ----
# Open Strips (288 )
mesh_6 = Mesh(flatten(dispatch_2.ListA))
Y_2 = UnitY(Factor=1)
multiplication_5 = Multiplication(A=Y_2, B="26")
move_3 = Move(Geometry=mesh_6, Motion=multiplication_5)  # -> Geometry, Transform
mesh_7 = Mesh(move_3.Geometry)
weldvertices_5 = MeshWeldVertices(Mesh=mesh_7, Tolerance=0.01)  # -> RuntimeMessage, Mesh

# ----
# Open Strip Viewer : Individual
number_slider_4 = Slider(0, range=0..119)
item_7 = ListItem(List=weldvertices_5.Mesh, Index=number_slider_4, Wrap=True)  # -> Item, Item1, Item2, Item3, Item4, Item5, Item6
mesh_8 = Mesh([item_7.Item, item_7.Item1, item_7.Item2, item_7.Item3, item_7.Item4, item_7.Item5, item_7.Item6])

# ----
# Open Strip Viewer : Individual Strips Flattened
# The unroller flattens quad strips onto the plane of the 1st quad of the strip
number_slider_5 = Slider(12, range=0..287)
list_item = ListItem(List=flatten(weldvertices_5.Mesh), Index=number_slider_5, Wrap=True)
unroller = Unroller(Strip=list_item, Unroll=1)  # -> simplify(graft(Unrolled))
mesh_9 = Mesh(list_item)

# ----
# Open Strip Viewer : Groups
number_slider_6 = Slider(33, range=0..71)
partition = PartitionList(List=weldvertices_5.Mesh, Size="4")
flip = FlipMatrix(Data=partition)
item_8 = ListItem(List=flip, Index=number_slider_6, Wrap=True)  # -> flatten(Item)
mesh_10 = Mesh(item_8)

# ----
# Closed Mesh Strips (120 )
# Closed Loop Notes: 120 Closed Loops
# 15 Groups (the 15 Feet/Holes)
# 5 Feet and 10 Holes
# Always from Shortest to Longest Strips
# Always 8 strips per Foot/Hole
# All Meshes (V:64 F:32)
# 
# Items 0 - 7 = Foot 1
# Items 8 - 15 = Hole 1
# 
# Items 16 - 23 = Foot 2
# Items 24 - 31 = Foot 3
# 
# Items 32 - 39 = Hole 2
# Items 40 - 47 = Hole 3
# Items 48 - 55 = Hole 4
# Items 56 - 63 = Hole 5
# Items 64 - 71 = Hole 6
# Items 72 - 79 = Foot 4
# Items 80 - 87 = Foot 5
# Items 88 - 95 = Hole 7
# Items 96 - 103 = Hole 8
# Items 104 - 111 = Hole 9
# 
# Items 112 - 119 = Hole 10
weldvertices_6 = MeshWeldVertices(Mesh=unloop, Tolerance=0.01)  # -> RuntimeMessage, Mesh
no_data_collected_no_closed_loops = Panel(weldvertices_6.Mesh)

# ----
# Open Meshes
# Closed Meshes
merge_6 = Merge(Data1=flatten(weldvertices_5.Mesh), Data2=flatten(weldvertices_6.Mesh))

# ----
# Surface Area
# Surface Area in MM2 Before Scaling
area = MeshArea(Mesh=merge_6)  # -> flatten(Area), Centroid
ma = MassAddition(Input=area.Area)  # -> Result, PartialResults
square_millimetres = Panel(ma.Result)

multiplication_6 = Multiplication(XScaling=panel_2, YScaling=panel_2)
multiplication_7 = Multiplication(A=square_millimetres, B=multiplication_6)

# ----
# Surface Area in M2 After Scaling
panel_12 = Panel("1000000")
division_3 = Division(A=multiplication_7, B=panel_12)
square_metres = Panel(division_3)

# ----
# Sheet Metal Weight
# Sheet metal weight/M2 calculated at https://www.kloecknermetals.com/metal-calculator/
grammes_m2 = Panel("4187")
multiplication_8 = Multiplication(A=grammes_m2, B=division_3)
division_4 = Division(A=multiplication_8, B="1000")
kilogrammes = Panel(division_4)

# ----
# Closed Strip Viewer : Individual
number_slider_7 = Slider(0, range=0..119)
item_9 = ListItem(List=weldvertices_6.Mesh, Index=number_slider_7, Wrap=True)
mesh_11 = Mesh(item_9)

# ----
# Closed Strip Viewer : Groups
panel_13 = Panel("8")
partition_2 = PartitionList(List=weldvertices_6.Mesh, Size=panel_13)
flip_2 = FlipMatrix(Data=partition_2)
item_10 = ListItem(List=flip_2, Index=Slider(0, range=0..14), Wrap=True)  # -> flatten(Item)
mesh_12 = Mesh(item_10)

merge_7 = Merge(Data1=flatten(dispatch_2.ListA), Data2=unloop)

# ---- group: Short-Circuit before the Unroller to see individual parts unrolled
list_item_2 = ListItem(List=merge_7, Index=Slider(0, range=0..48), Wrap=True)  # -> Item, Item1, Item2, Item3, Item4, Item5, Item6, Item7

# ----
mesh_13 = Mesh([list_item_2.Item, list_item_2.Item1, list_item_2.Item2, list_item_2.Item3, list_item_2.Item4, list_item_2.Item5, list_item_2.Item6, list_item_2.Item7])

# ----
# Different Lengths (Nº of Faces)
demesh_2 = DeconstructMesh(Mesh=weldvertices_5.Mesh)  # -> Vertices, Faces, Colours, Normals
lng_2 = ListLength(List=demesh_2.Faces)  # -> flatten(Length)
cset = CreateSet(List=lng_2)  # -> Set, Map
sort = SortList(Keys=cset.Set)  # -> Keys, ValuesA
panel_14 = Panel(sort.Keys)

explode_3 = MeshExplode(Mesh=weldvertices_6.Mesh, Interpolate=False)

# ----
# Closed Strips all
#    (V:64 F:32)
Y_3 = UnitY(Factor=1)
mesh_14 = Mesh(weldvertices_6.Mesh)
multiplication_9 = Multiplication(A=Y_3, B="26")
move_4 = Move(Geometry=mesh_14, Motion=multiplication_9)  # -> Geometry, Transform
mesh_15 = Mesh(move_4.Geometry)

Y_4 = UnitY(Factor=1)
multiplication_10 = Multiplication(A=Y_4, B="26")

# ----
# Nº of Strips of
# different lengths
sort_2 = SortList(Keys=lng_2, ValuesA=weldvertices_5.Mesh)  # -> Keys, ValuesA
split = SplitList(List=sort_2.ValuesA, Index="32")  # -> ListA, ListB
split_2 = SplitList(List=split.ListB, Index="112")  # -> ListA, ListB
split_3 = SplitList(List=split_2.ListB, Index="56")  # -> ListA, ListB
item_11 = ListItem(List=split_2.ListA, Index=0, Wrap=True)
item_12 = ListItem(List=split_3.ListA, Index=0, Wrap=True)
item_13 = ListItem(List=split.ListA, Index=0, Wrap=True)
panel_15 = Panel(item_13)
panel_16 = Panel(item_12)
panel_17 = Panel(item_11)
mesh_16 = Mesh(split_3.ListA)
mesh_17 = Mesh(split.ListA)
mesh_18 = Mesh(split_2.ListA)

split_4 = SplitList(List=split_3.ListB, Index="16")  # -> ListA, ListB
item_14 = ListItem(List=split_4.ListA, Index=0, Wrap=True)
panel_18 = Panel(item_14)
mesh_19 = Mesh(split_4.ListA)

split_5 = SplitList(List=split_4.ListB, Index="32")  # -> ListA, ListB
split_6 = SplitList(List=split_5.ListB, Index="16")  # -> ListA, ListB
split_7 = SplitList(List=split_6.ListB, Index="16")  # -> ListA, ListB
split_8 = SplitList(List=split_7.ListB, Index="8")  # -> ListA, ListB
item_15 = ListItem(List=split_6.ListA, Index=0, Wrap=True)
item_16 = ListItem(List=split_5.ListA, Index=0, Wrap=True)
item_17 = ListItem(List=split_8.ListA, Index=0, Wrap=True)
item_18 = ListItem(List=split_7.ListA, Index=0, Wrap=True)
panel_19 = Panel(item_15)
panel_20 = Panel(item_17)
panel_21 = Panel(item_16)
panel_22 = Panel(item_18)
mesh_20 = Mesh(split_5.ListA)
mesh_21 = Mesh(split_6.ListA)
mesh_22 = Mesh(split_8.ListA)
mesh_23 = Mesh(split_7.ListA)

# ----
# Nº of Strips of
# different lengths
sort_3 = SortList(Keys=lng_2, ValuesA=weldvertices_4.Mesh)  # -> Keys, ValuesA
split_9 = SplitList(List=sort_3.ValuesA, Index="32")  # -> ListA, ListB
split_10 = SplitList(List=split_9.ListB, Index="112")  # -> ListA, ListB
split_11 = SplitList(List=split_10.ListB, Index="56")  # -> ListA, ListB
item_19 = ListItem(List=split_10.ListA, Index=0, Wrap=True)
item_20 = ListItem(List=split_11.ListA, Index=0, Wrap=True)
item_21 = ListItem(List=split_9.ListA, Index=0, Wrap=True)
panel_23 = Panel(item_21)
panel_24 = Panel(item_20)
panel_25 = Panel(item_19)
mesh_24 = Mesh(split_11.ListA)
mesh_25 = Mesh(split_9.ListA)
mesh_26 = Mesh(split_10.ListA)

split_12 = SplitList(List=split_11.ListB, Index="16")  # -> ListA, ListB
item_22 = ListItem(List=split_12.ListA, Index=0, Wrap=True)
panel_26 = Panel(item_22)
mesh_27 = Mesh(split_12.ListA)

split_13 = SplitList(List=split_12.ListB, Index="32")  # -> ListA, ListB
split_14 = SplitList(List=split_13.ListB, Index="16")  # -> ListA, ListB
split_15 = SplitList(List=split_14.ListB, Index="16")  # -> ListA, ListB
split_16 = SplitList(List=split_15.ListB, Index="8")  # -> ListA, ListB
item_23 = ListItem(List=split_14.ListA, Index=0, Wrap=True)
item_24 = ListItem(List=split_13.ListA, Index=0, Wrap=True)
item_25 = ListItem(List=split_16.ListA, Index=0, Wrap=True)
item_26 = ListItem(List=split_15.ListA, Index=0, Wrap=True)
panel_27 = Panel(item_23)
panel_28 = Panel(item_25)
panel_29 = Panel(item_24)
panel_30 = Panel(item_26)
mesh_28 = Mesh(split_13.ListA)
mesh_29 = Mesh(split_14.ListA)
mesh_30 = Mesh(split_16.ListA)
mesh_31 = Mesh(split_15.ListA)

item_27 = ListItem(List=mesh_25, Index=Slider(0, range=0..31), Wrap=True)

# ----
# This gets the Quad Centrepoints
# Quad
# Vertices
# Quad
# Centrepoints
demesh_3 = DeconstructMesh(Mesh=item_27)  # -> Vertices, Faces, Colours, Normals
deconstruct_face = DeconstructFace(Face=demesh_3.Faces)  # -> CornerA, CornerB, CornerC, CornerD
flatten_tree = FlattenTree(Tree=deconstruct_face.CornerA, Path="0")
flatten_tree_2 = FlattenTree(Tree=deconstruct_face.CornerB, Path="0")
flatten_tree_3 = FlattenTree(Tree=deconstruct_face.CornerC, Path="0")
flatten_tree_4 = FlattenTree(Tree=deconstruct_face.CornerD, Path="0")
flatten_tree_5 = FlattenTree(Tree=demesh_3.Vertices, Path="{0}")
entwine = Entwine(Branch00=flatten_tree, Branch01=flatten_tree_2, Branch02=flatten_tree_3, Branch03=flatten_tree_4, FlattenInputs=True)
flip_matrix = FlipMatrix(Data=entwine)
list_item_3 = ListItem(List=flatten_tree_5, Index=flip_matrix, Wrap=True)
average = Average(Input=list_item_3)  # -> flatten(ArithmeticMean)

# ----
# This gets the Quad Centrepoints at each end of the strip
weaverbird_s_unify_face_windings = WeaverbirdsUnifyFaceWindings(MeshCurves=item_27)
weaverbird_s_face_polylines = WeaverbirdsFacePolylines(Mesh=weaverbird_s_unify_face_windings)
weaverbird_s_naked_boundary = WeaverbirdsNakedBoundary(MeshClosedPolylines=weaverbird_s_face_polylines)
explode_4 = Explode(Curve=weaverbird_s_naked_boundary, Recursive=True)  # -> Segments, Vertices
shift_list = ShiftList(List=explode_4.Segments, Shift="1", Wrap=True)
list_length = ListLength(List=explode_4.Segments)
# Mesh Strip Splitter
angle = Angle(VectorA=explode_4.Segments, VectorB=shift_list)  # -> Angle, Reflex
series_2 = Series(Start="0", Step="1", Count=list_length)
division_5 = Division(A=list_length, B="2")
sort_list = SortList(Keys=angle.Angle, ValuesValuesA=series_2)  # -> Keys, ValuesValuesA
list_item_4 = ListItem(List=sort_list.ValuesValuesA, Index="-1", Wrap=True)  # -> flatten(Item)
addition = Addition(A=division_5, B="1")
addition_2 = Addition(A=list_item_4, B="1")
panel_31 = Panel(list_item_4)
shift_list_2 = ShiftList(List=explode_4.Segments, Shift=addition_2, Wrap=True)
split_list = SplitList(List=shift_list_2, Index=addition)  # -> ListA, ListB
end_points = EndPoints(Curve=split_list.ListA)  # -> Start, End
list_item_5 = ListItem(List=end_points.Start, Index="0", Wrap=True)
list_item_6 = ListItem(List=end_points.Start, Index="-1", Wrap=True)
closest_point = ClosestPoint(Point=list_item_5, Cloud=average)  # -> ClosestPoint, CPIndex, Distance
closest_point_2 = ClosestPoint(Point=list_item_6, Cloud=average)  # -> ClosestPoint, CPIndex, Distance

list_length_2 = ListLength(List=split_list.ListA)
integer_division = IntegerDivision(A=list_length_2, B="2")
list_item_7 = ListItem(List=split_list.ListA, Index=integer_division, Wrap=True)
end_points_2 = EndPoints(Curve=list_item_7)  # -> Start, End
point = Point(end_points_2.Start)

# ----
# This makes the Quad Faces contiguous Anti-Clockwise
line = Line(StartPoint=closest_point.ClosestPoint, EndPoint=closest_point_2.ClosestPoint)
curve_middle = CurveMiddle(Curve=line)
plane_by_line = PlaneByLine(Line=line, Axis=0)
vector_2pt = Vector2Pt(PointA=closest_point.ClosestPoint, PointB=curve_middle, Unitize=False)  # -> Vector, Length
orient = Orient(Geometry=plane_by_line, Source=closest_point.ClosestPoint, Target=curve_middle)  # -> Geometry, Transform
line_sdl = LineSDL(Start=curve_middle, Direction=vector_2pt.Vector, Length=vector_2pt.Length)
rotate = Rotate(Geometry=line_sdl, Angle="Pi/2", Plane=orient.Geometry)  # -> Geometry, Transform
rotate_2 = Rotate(Geometry=line_sdl, Angle="-Pi/2", Plane=orient.Geometry)  # -> Geometry, Transform
end_points_3 = EndPoints(Curve=rotate.Geometry)  # -> Start, End
end_points_4 = EndPoints(Curve=rotate_2.Geometry)  # -> Start, End
line_2 = Line(rotate.Geometry)
line_3 = Line(rotate_2.Geometry)
point_2 = Point(end_points_3.End)
point_3 = Point(end_points_4.End)
entwine_2 = Entwine(Branch00=end_points_3.End, Branch01=end_points_4.End, FlattenInputs=True)  # -> flatten(Result)
entwine_3 = Entwine(Branch00=line_2, Branch01=line_3, FlattenInputs=True)  # -> flatten(Result)
closest_point_3 = ClosestPoint(Point=point, Cloud=entwine_2)  # -> ClosestPoint, CPIndex, Distance
point_4 = Point(closest_point_3.ClosestPoint)
equality = Equality(FirstNumber=closest_point_3.CPIndex, SecondNumber="0")  # -> flatten(Equality), flatten(Inequality)
panel_32 = Panel(equality.Equality)
panel_33 = Panel(equality.Inequality)
entwine_4 = Entwine(Branch00=equality.Equality, Branch01=equality.Inequality, FlattenInputs=True)  # -> flatten(Result)
panel_34 = Panel(entwine_4)
dispatch_3 = Dispatch(List=entwine_3, DispatchPattern=entwine_4)  # -> ListA, ListB
dispatch_4 = Dispatch(List=entwine_2, DispatchPattern=entwine_4)  # -> ListA, ListB
point_5 = Point(dispatch_4.ListB)
line_4 = Line(dispatch_3.ListB)
line_5 = Line(StartPoint=dispatch_4.ListB, EndPoint=average)
mesh_explode = MeshExplode(Mesh=item_27, Interpolate=False)
angle_2 = Angle(VectorA=line_4, VectorB=line_5, Plane=orient.Geometry)  # -> flatten(Angle), Reflex
sort_list_2 = SortList(Keys=angle_2.Angle, ValuesValuesA=mesh_explode)  # -> Keys, ValuesValuesA

# ----
# Least difference between strip lengths : If the modulus is less than half the number of strips, then make (X-1) strips of "nearest" and 1 strip of the remaining items else make (X-1) strips of "ceiling" and 1 strip of the remaining items
list_length_3 = ListLength(List=sort_list_2.ValuesValuesA)
division_6 = Division(A=list_length_3, B=desired_number_of_strips)
panel_35 = Panel(division_6)
division_7 = Division(A=desired_number_of_strips, B="2")
round = Round(Number=division_6)  # -> Nearest, Floor, Ceiling
ceiling = Panel(round.Ceiling)
nearest = Panel(round.Nearest)
modulus = Modulus(A=list_length_3, B=desired_number_of_strips)
panel_36 = Panel(modulus)
larger_than = LargerThan(FirstNumber=modulus, SecondNumber=division_7)  # -> LargerThan, OrEqualTo

# ----
# Low Modulus : Gate 0 (or False): make X strips of "nearest" and append the remaining items to the final branch, which already exists
panel_37 = Panel("0")
subtraction = Subtraction(A=desired_number_of_strips, B=panel_37)
multiplication_11 = Multiplication(A=round.Nearest, B=subtraction)
split_list_2 = SplitList(List=sort_list_2.ValuesValuesA, Index=multiplication_11)  # -> ListA, ListB
partition_list = PartitionList(List=split_list_2.ListA, Size=round.Nearest)  # -> simplify(Chunks)
subtraction_2 = Subtraction(A=desired_number_of_strips, B="1")
flatten_tree_6 = FlattenTree(Tree=split_list_2.ListB, Path=subtraction_2)
merge_8 = Merge(Data1=partition_list, Data2=flatten_tree_6)

# ----
# High Modulus : Gate 1 (or True): make (X-1) strips of "ceiling" and add the final separate strip with the remaining items in their own branch
panel_38 = Panel("1")
subtraction_3 = Subtraction(A=desired_number_of_strips, B=panel_38)
multiplication_12 = Multiplication(A=round.Ceiling, B=subtraction_3)
split_list_3 = SplitList(List=sort_list_2.ValuesValuesA, Index=multiplication_12)  # -> ListA, ListB
partition_list_2 = PartitionList(List=split_list_3.ListA, Size=round.Ceiling)  # -> simplify(Chunks)
subtraction_4 = Subtraction(A=desired_number_of_strips, B="1")
flatten_tree_7 = FlattenTree(Tree=split_list_3.ListB, Path=subtraction_4)
merge_9 = Merge(Data1=partition_list_2, Data2=flatten_tree_7)

# ----
# This makes the chosen number of strips
stream_filter = StreamFilter(Gate=larger_than.LargerThan, Stream0=merge_8, Stream1=merge_9)

# ----
# Full Mesh Tree
mesh_join = MeshJoin(Meshes=stream_filter)

# ----
# List Item Viewer
number_slider_8 = Slider(0, range=0..10)
list_item_8 = ListItem(List=flatten(mesh_join), Index=number_slider_8, Wrap=False)
mesh_stats = Panel(list_item_8)

panel_39 = Panel(mesh_join)
mesh_32 = Mesh(list_item_8)

# ----
# The unroller flattens quad strips
# 
# It flattens the whole strip onto the plane of the 1st quad of the strip
unroller_2 = Unroller(Strip=mesh_32, Unroll=1)  # -> simplify(graft(Unrolled))

# ----
# How This Works: This makes a 'best fit plane' for the unrolled strip.
# 
# The plane's origin is based on the average of the centrepoints of all the quads.
# 
# The plane's Z direction is based on the average of the face normals of all the quads.
# 
# These new planes are used to reorient the parts to the origin of the XY Plane
facen_2 = FaceNormals(Mesh=unroller_2)  # -> Centers, Normals
avr = Average(Input=facen_2.Normals)
avr_2 = Average(Input=facen_2.Centers)
pl = PlaneNormal(Origin=avr_2, ZAxis=avr)
orient_2 = Orient(Geometry=unroller_2, Source=pl, Target=PlaneXY(0, 0, 0))  # -> Geometry, Transform

# ---- group: Minimum Bounding Box
# How This Works: Shift Paths, with the 'Offset' set to -1, changes what was 36 branches of 1 item each into branches with 36 items each: precisely the items we need to sort in order of size.
# How This Works: Shift Item, with i set to 0, gets the smallest bounding box for each strip since they are already sorted for size.
bbox_2 = BoundingBox(Content=orient_2.Geometry, Plane=prot)  # -> Box, Box_2
pshift = ShiftPaths(Data=bbox_2.Box, Offset=-1)
area_2 = Area(Geometry=pshift)  # -> Area, Centroid
index = ItemIndex(List=area_2.Centroid, Item=area_2.Centroid)
sort_4 = SortList(Keys=area_2.Area, ValuesA=index)  # -> Keys, ValuesA
item_28 = ListItem(List=sort_4.ValuesA, Index=0, Wrap=True)
item_29 = ListItem(List=pshift, Index=item_28, Wrap=True)

# ----
before_shift_paths = Panel(bbox_2.Box)
after_shift_paths = Panel(pshift)
panel_40 = Panel(sort_4.ValuesA)

# ----
# 'Manual' Nesting
# (to see the steps an algorithm would require)
item_30 = ListItem(List=flatten(orient_2.Geometry), Index=0, Wrap=True)  # -> Item, Item1, Item2, Item3, Item4, Item5, Item6, Item7
X = UnitX(Factor=1)
X_2 = UnitX(Factor=1)
X_3 = UnitX(Factor=1)
X_4 = UnitX(Factor=1)
X_5 = UnitX(Factor=1)
X_6 = UnitX(Factor=1)
X_7 = UnitX(Factor=1)
X_8 = UnitX(Factor=1)
multiplication_13 = Multiplication(A=X, B=Slider(10.639, range=0..100))
multiplication_14 = Multiplication(A=X_2, B=Slider(9.446, range=0..100))
multiplication_15 = Multiplication(A=X_3, B=Slider(8.371, range=0..100))
multiplication_16 = Multiplication(A=X_4, B=Slider(7.629, range=0..100))
multiplication_17 = Multiplication(A=X_5, B=Slider(8, range=0..100))
multiplication_18 = Multiplication(A=X_6, B=Slider(9, range=0..100))
multiplication_19 = Multiplication(A=X_7, B=Slider(10, range=0..100))
multiplication_20 = Multiplication(A=X_8, B=Slider(11, range=0..100))
move_5 = Move(Geometry=item_30.Item, Motion=multiplication_13)  # -> Geometry, Transform
move_6 = Move(Geometry=item_30.Item1, Motion=multiplication_14)  # -> Geometry, Transform
move_7 = Move(Geometry=item_30.Item5, Motion=multiplication_18)  # -> Geometry, Transform
move_8 = Move(Geometry=item_30.Item2, Motion=multiplication_15)  # -> Geometry, Transform
move_9 = Move(Geometry=item_30.Item4, Motion=multiplication_17)  # -> Geometry, Transform
move_10 = Move(Geometry=item_30.Item6, Motion=multiplication_19)  # -> Geometry, Transform
move_11 = Move(Geometry=item_30.Item3, Motion=multiplication_16)  # -> Geometry, Transform
move_12 = Move(Geometry=item_30.Item7, Motion=multiplication_20)  # -> Geometry, Transform
facen_3 = FaceNormals(Mesh=move_6.Geometry)  # -> Centers, Normals
facen_4 = FaceNormals(Mesh=move_10.Geometry)  # -> Centers, Normals
facen_5 = FaceNormals(Mesh=move_7.Geometry)  # -> Centers, Normals
facen_6 = FaceNormals(Mesh=move_11.Geometry)  # -> Centers, Normals
facen_7 = FaceNormals(Mesh=move_9.Geometry)  # -> Centers, Normals
facen_8 = FaceNormals(Mesh=move_12.Geometry)  # -> Centers, Normals
facen_9 = FaceNormals(Mesh=move_5.Geometry)  # -> Centers, Normals
facen_10 = FaceNormals(Mesh=move_8.Geometry)  # -> Centers, Normals
avr_3 = Average(Input=facen_3.Centers)
avr_4 = Average(Input=facen_4.Centers)
avr_5 = Average(Input=facen_5.Centers)
avr_6 = Average(Input=facen_6.Centers)
avr_7 = Average(Input=facen_7.Centers)
avr_8 = Average(Input=facen_8.Centers)
avr_9 = Average(Input=facen_9.Centers)
avr_10 = Average(Input=facen_10.Centers)
xy_2 = XYPlane(Origin=avr_3)
rad_2 = Radians(Degrees=Slider(-15, range=-180..180))
xy_3 = XYPlane(Origin=avr_4)
rad_3 = Radians(Degrees=Slider(-166.5, range=-180..180))
xy_4 = XYPlane(Origin=avr_5)
rad_4 = Radians(Degrees=Slider(-172, range=-180..180))
xy_5 = XYPlane(Origin=avr_6)
rad_5 = Radians(Degrees=Slider(-4, range=-180..180))
xy_6 = XYPlane(Origin=avr_7)
xy_7 = XYPlane(Origin=avr_8)
xy_8 = XYPlane(Origin=avr_9)
xy_9 = XYPlane(Origin=avr_10)
rad_6 = Radians(Degrees=Slider(-178, range=-180..180))
rad_7 = Radians(Degrees=Slider(-162, range=-180..180))
rad_8 = Radians(Degrees=Slider(-18.906, range=-180..180))
rad_9 = Radians(Degrees=Slider(-10.58, range=-180..180))
rotate_3 = Rotate(Geometry=move_6.Geometry, Angle=rad_2, Plane=xy_2)  # -> Geometry, Transform
rotate_4 = Rotate(Geometry=move_10.Geometry, Angle=rad_3, Plane=xy_3)  # -> Geometry, Transform
rotate_5 = Rotate(Geometry=move_7.Geometry, Angle=rad_4, Plane=xy_4)  # -> Geometry, Transform
rotate_6 = Rotate(Geometry=move_11.Geometry, Angle=rad_5, Plane=xy_5)  # -> Geometry, Transform
rotate_7 = Rotate(Geometry=move_9.Geometry, Angle=rad_6, Plane=xy_6)  # -> Geometry, Transform
rotate_8 = Rotate(Geometry=move_12.Geometry, Angle=rad_7, Plane=xy_7)  # -> Geometry, Transform
rotate_9 = Rotate(Geometry=move_5.Geometry, Angle=rad_8, Plane=xy_8)  # -> Geometry, Transform
rotate_10 = Rotate(Geometry=move_8.Geometry, Angle=rad_9, Plane=xy_9)  # -> Geometry, Transform
mesh_33 = Mesh(rotate_6.Geometry)
mesh_34 = Mesh(rotate_8.Geometry)
mesh_35 = Mesh(rotate_3.Geometry)
mesh_36 = Mesh(rotate_7.Geometry)
mesh_37 = Mesh(rotate_9.Geometry)
mesh_38 = Mesh(rotate_4.Geometry)
mesh_39 = Mesh(rotate_10.Geometry)
mesh_40 = Mesh(rotate_5.Geometry)

panel_41 = Panel("What happens here?")
debrep = DeconstructBrep(Brep=item_29)  # -> Faces, Edges, Vertices

# ----
# Closed Strips all
#    (V:64 F:32)
mesh_41 = Mesh(weldvertices_6.Mesh)
Y_5 = UnitY(Factor=1)
multiplication_21 = Multiplication(A=Y_5, B="26")

move_13 = Move(Geometry=mesh_41, Motion=multiplication_10)  # -> Geometry, Transform
mesh_42 = Mesh(move_13.Geometry)
weldvertices_7 = MeshWeldVertices(Mesh=mesh_42, Tolerance=0.01)  # -> RuntimeMessage, Mesh

move_14 = Move(Geometry=weldvertices_7.Mesh, Motion=multiplication_21)  # -> Geometry, Transform
mesh_43 = Mesh(move_14.Geometry)

# ----
# This organises for laying out the strips
item_31 = ListItem(List=reverse(debrep.Faces), Index=0, Wrap=True)
X_9 = UnitX(Factor=1)
crv = Curve(flatten(<curve referenced from the Rhino model>))

# ---- group: Ordering by smaller edge length
dim = Dimensions(Surface=item_31)  # -> UDimension, VDimension
min = Minimum(A=dim.UDimension, B=dim.VDimension)  # -> flatten(Result)
expression = Expression(x=dim.UDimension, y=dim.VDimension, Expression="if(x<y,0,1)")  # -> flatten(R)
index_2 = ItemIndex(List=min, Item=min)
sort_5 = SortList(Keys=min, ValuesA=index_2, ValuesB=expression)  # -> reverse(Keys), reverse(ValuesA), reverse(ValuesB)

# ----
list_item_9 = ListItem(List=item_31, Index=Slider(0, range=0..47), Wrap=True)

item_32 = ListItem(List=flatten(orient_2.Geometry), Index=sort_5.ValuesA, Wrap=True)
item_33 = ListItem(List=flatten(item_31), Index=sort_5.ValuesA, Wrap=True)
ma_2 = MassAddition(Input=sort_5.Keys)  # -> Result, PartialResults
edges = BrepEdges(Brep=item_33)  # -> Naked, Interior, NonManifold
subtraction_5 = Subtraction(A=ma_2.PartialResults, B=sort_5.Keys)
item_34 = ListItem(List=edges.Naked, Index=graft(sort_5.ValuesB), Wrap=True)
pt_10 = ConstructPoint(XCoordinate=subtraction_5, YCoordinate=0, ZCoordinate=0)
end = EndPoints(Curve=item_34)  # -> Start, End
vec2pt = Vector2Pt(PointA=end.Start, PointB=end.End, Unitize=False)  # -> Vector, Length
unit = UnitVector(Vector=vec2pt.Vector)
orient_3 = OrientDirection(Geometry=graft(item_32), PointA=end.Start, DirectionA=unit, PointB=graft(pt_10), DirectionB=graft(X_9))  # -> Geometry, Transform
orient_4 = OrientDirection(Geometry=edges.Naked, PointA=end.Start, DirectionA=unit, PointB=graft(pt_10), DirectionB=graft(X_9))  # -> Geometry, Transform
wbedges_2 = WeaverbirdsMeshEdges(MeshOrPolylines=orient_3.Geometry)
wbnaked_2 = WeaverbirdsNakedBoundary(MeshClosedPolylines=orient_3.Geometry)  # -> flatten(NakedCurves)
preview_3 = CustomPreview(Geometry=[wbedges_2, orient_3.Geometry], Material=graft(ColourSwatch(SwatchColor=RGB(110, 110, 110))))
preview_4 = CustomPreview(Geometry=orient_4.Geometry, Material=graft(ColourSwatch(SwatchColor=RGB(0, 0, 0))))
opennest = OpenNest(
    Sheets=crv,
    Geo=wbnaked_2,
    Spacing=Slider(0.7, range=0..1),
    Placement=1,
    Tolerance=0.1,
    Rotations="4",
    Iterations="4",
    Seed=1,
    Reset=Button(),
    Run=Toggle(True))  # -> Sheets, Geo, ID, Transform, IDS; disabled
transform = Transform(Transform=opennest.Transform)

crv_2 = Curve(wbnaked_2)

# ==== cluster UnloopMesh: This component will opens looping mesh strip
mesh_loop = ClusterInput()  # Insert all the strips, the closed one will be opened
angle = ClusterInput()  # Angle of rotation
precision = ClusterInput()  # Precision
mesh = Mesh(mesh_loop)
graft = GraftTree(Tree=mesh, IncludeEmptyLists=True, IncludeNullItems=True)
wbnaked = WeaverbirdsNakedBoundary(MeshClosedPolylines=graft)
panel = Panel(graft)
lng = ListLength(List=wbnaked)
panel_2 = Panel(wbnaked)
equals = Equality(FirstNumber=lng, SecondNumber="1")  # -> Equality, Inequality
toggle = BooleanToggle(True)
toggle_2 = BooleanToggle(True)
sift = SiftPattern(List=graft, SiftPattern=equals.Equality)  # -> Output0, Output1
clean = CleanTree(RemoveNulls=toggle_2, RemoveInvalid=toggle_2, RemoveEmpty=toggle_2, Tree=sift.Output0)  # -> simplify(Tree)
clean_2 = CleanTree(RemoveNulls=toggle, RemoveInvalid=toggle, RemoveEmpty=toggle, Tree=sift.Output1)  # -> simplify(Tree)
panel_3 = Panel(lng)

mesh_2 = Mesh(clean)
facen = FaceNormals(Mesh=mesh_2)  # -> Centers, Normals
lng_2 = ListLength(List=facen.Centers)
explode = MeshExplode(Mesh=mesh_2, Interpolate=False)
series = Series(Start=0, Step=1, Count=lng_2)
int = Integer(series)

faceb = FaceBoundaries(Mesh=mesh_2)

explode_2 = Explode(Curve=faceb, Recursive=True)  # -> Segments, Vertices
end = EndPoints(Curve=graft(explode_2.Segments))  # -> Start, End
avr = Average(Input=[end.Start, end.End])
pshift = ShiftPaths(Data=avr, Offset=-1)
item = ListItem(List=pshift, Index=0, Wrap=True)  # -> Item, Item1, Item2
ln = Line(StartPoint=item.Item, EndPoint=item.Item2)
pshift_2 = ShiftPaths(Data=ln, Offset=-1)  # -> simplify(Data)
join = JoinCurves(Curves=pshift_2, Preserve=False)
crv_cp = CurveClosestPoint(Point=facen.Centers, Curve=reparameterize(join))  # -> Point, Parameter, Distance
sort = SortList(Keys=crv_cp.Parameter, ValuesA=int)  # -> Keys, ValuesA
rev = ReverseList(List=sort.ValuesA)
item_2 = ListItem(List=rev, Index=0, Wrap=True)
item_3 = ListItem(List=sort.ValuesA, Index=0, Wrap=True)
item_4 = ListItem(List=explode, Index=item_2, Wrap=True)
item_5 = ListItem(List=explode, Index=item_3, Wrap=True)
demesh = DeconstructMesh(Mesh=item_5)  # -> Vertices, Faces, Colours, Normals
demesh_2 = DeconstructMesh(Mesh=item_4)  # -> Vertices, Faces, Colours, Normals
intersection = SetIntersection(SetA=demesh.Vertices, SetB=demesh_2.Vertices)
item_6 = ListItem(List=intersection, Index=0, Wrap=True)  # -> Item, Item1
ln_2 = Line(StartPoint=item_6.Item, EndPoint=item_6.Item1)
rotax = RotateAxis(Geometry=item_5, Angle=angle, Axis=ln_2)  # -> Geometry, Transform
replace = ReplaceItems(List=explode, Item=rotax.Geometry, Indices=item_3, Wrap=False)
mjoin = MeshJoin(Meshes=replace)
weldvertices = MeshWeldVertices(Mesh=mjoin, Tolerance=precision)  # -> RuntimeMessage, simplify(Mesh)

item_7 = ListItem(List=ln, Index=0, Wrap=True)
merge = Merge(Data1=weldvertices.Mesh, Data2=clean_2)  # -> flatten(Result)
mesh_3 = Mesh(merge)
st = ClusterOutput(mesh_3)  # It gives you back jusy open strips
