# Grasshopper definition Project LoopS.gh (Grasshopper 1.0.7)
# plug-ins: MeshEdit Components, Weaverbird, Kangaroo2 Components, NGon, Human, LunchBox

panel = Panel("""0
4
5
6
7
8
12
13
14
15
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""")
panel_2 = Panel("""0
92
89
95
94
98
24
88
79
142
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""")
mesh = Mesh([<mesh referenced from the Rhino model> x168])
number_slider = Slider(1, range=0..2)
number_slider_2 = Slider(1, range=0..2)

mesh_2 = Mesh([<mesh referenced from the Rhino model> x98])
mjoin = MeshJoin(Meshes=mesh_2)
# different topology
weldvertices = MeshWeldVertices(Mesh=mjoin, Tolerance=0.01)  # -> RuntimeMessage, Mesh
wbcatmullclark = WeaverbirdsCatmullClarkSubdivision(MeshCurves=weldvertices.Mesh, Level="3", SmoothNakedEdges=number_slider_2)
move = Move(Geometry=wbcatmullclark, Motion="0,1600,0")  # -> Geometry, Transform

mesh_3 = Mesh([<mesh referenced from the Rhino model> x52])
mjoin_2 = MeshJoin(Meshes=mesh_3)
weldvertices_2 = MeshWeldVertices(Mesh=mjoin_2, Tolerance=0.01)  # -> RuntimeMessage, Mesh
wbcatmullclark_2 = WeaverbirdsCatmullClarkSubdivision(MeshCurves=weldvertices_2.Mesh, Level="3", SmoothNakedEdges=number_slider)
move_2 = Move(Geometry=wbcatmullclark_2, Motion="0,1600,0")  # -> Geometry, Transform

mesh_4 = Mesh([<mesh referenced from the Rhino model> x29])
mjoin_3 = MeshJoin(Meshes=mesh_4)
weldvertices_3 = MeshWeldVertices(Mesh=mjoin_3, Tolerance=0.01)  # -> RuntimeMessage, Mesh
wbcatmullclark_3 = WeaverbirdsCatmullClarkSubdivision(MeshCurves=weldvertices_3.Mesh, Level="3", SmoothNakedEdges=number_slider_2)
move_3 = Move(Geometry=wbcatmullclark_3, Motion="0,800,0")  # -> Geometry, Transform

mesh_5 = Mesh([<mesh referenced from the Rhino model> x25])
mjoin_4 = MeshJoin(Meshes=mesh_5)
weldvertices_4 = MeshWeldVertices(Mesh=mjoin_4, Tolerance=0.01)  # -> RuntimeMessage, Mesh
wbcatmullclark_4 = WeaverbirdsCatmullClarkSubdivision(MeshCurves=weldvertices_4.Mesh, Level="3", SmoothNakedEdges=number_slider)
move_4 = Move(Geometry=wbcatmullclark_4, Motion="0,1600,0")  # -> Geometry, Transform

mesh_6 = Mesh([<mesh referenced from the Rhino model> x59])
mjoin_5 = MeshJoin(Meshes=mesh_6)
weldvertices_5 = MeshWeldVertices(Mesh=mjoin_5, Tolerance=0.01)  # -> RuntimeMessage, Mesh
wbcatmullclark_5 = WeaverbirdsCatmullClarkSubdivision(MeshCurves=weldvertices_5.Mesh, Level="3", SmoothNakedEdges=number_slider_2)
move_5 = Move(Geometry=wbcatmullclark_5, Motion="0,800,0")  # -> Geometry, Transform

mesh_7 = Mesh([<mesh referenced from the Rhino model> x37])
mjoin_6 = MeshJoin(Meshes=mesh_7)
weldvertices_6 = MeshWeldVertices(Mesh=mjoin_6, Tolerance=0.01)  # -> RuntimeMessage, Mesh
wbcatmullclark_6 = WeaverbirdsCatmullClarkSubdivision(MeshCurves=weldvertices_6.Mesh, Level="3", SmoothNakedEdges=number_slider)
move_6 = Move(Geometry=wbcatmullclark_6, Motion="0,1600,0")  # -> Geometry, Transform

mesh_8 = Mesh([<mesh referenced from the Rhino model> x40])
mjoin_7 = MeshJoin(Meshes=mesh_8)
weldvertices_7 = MeshWeldVertices(Mesh=mjoin_7, Tolerance=0.01)  # -> RuntimeMessage, Mesh
wbcatmullclark_7 = WeaverbirdsCatmullClarkSubdivision(MeshCurves=weldvertices_7.Mesh, Level="3", SmoothNakedEdges=number_slider)
move_7 = Move(Geometry=wbcatmullclark_7, Motion="0,1600,0")  # -> Geometry, Transform

mesh_9 = Mesh([<mesh referenced from the Rhino model> x114])
mjoin_8 = MeshJoin(Meshes=mesh_9)
weldvertices_8 = MeshWeldVertices(Mesh=mjoin_8, Tolerance=0.01)  # -> RuntimeMessage, Mesh
wbcatmullclark_8 = WeaverbirdsCatmullClarkSubdivision(MeshCurves=weldvertices_8.Mesh, Level="3", SmoothNakedEdges=number_slider_2)
move_8 = Move(Geometry=wbcatmullclark_8, Motion="0,800,0")  # -> Geometry, Transform

mesh_10 = Mesh([<mesh referenced from the Rhino model> x56])
mjoin_9 = MeshJoin(Meshes=mesh_10)
weldvertices_9 = MeshWeldVertices(Mesh=mjoin_9, Tolerance=0.01)  # -> RuntimeMessage, Mesh
wbcatmullclark_9 = WeaverbirdsCatmullClarkSubdivision(MeshCurves=weldvertices_9.Mesh, Level="3", SmoothNakedEdges=number_slider_2)
move_9 = Move(Geometry=wbcatmullclark_9, Motion="0,800,0")  # -> Geometry, Transform

# ----
# Meshes
panel_3 = Panel(mjoin_6)
stripper = Stripper(Mesh=move.Geometry)
move_10 = Move(Geometry=stripper, Motion="0,800,0")  # -> Geometry, Transform
dispatch = Dispatch(List=move_10.Geometry, DispatchPattern=[True, False])  # -> ListA, ListB
preview = CustomPreview(Geometry=dispatch.ListB, Shader=ColourSwatch(SwatchColor=RGB(0, 0, 0)))
preview_2 = CustomPreview(Geometry=dispatch.ListA, Shader=ColourSwatch(SwatchColor=RGB(255, 255, 0)))

panel_4 = Panel("0,00,0")
list = ValueList({"Min": 0, "Max": 1, "Gaussian": 2, "Mean": 3, "Absolute": 4, "Difference": 5, "Rms": 6}, selected="Min")
move_11 = Move(Geometry=wbcatmullclark_3, Motion="0,1600,0")  # -> Geometry, Transform
merge = Merge(
    Data1=ColourSwatch(SwatchColor=RGB(255, 85, 0)),
    Data2=ColourSwatch(SwatchColor=RGB(106, 255, 0)),
    Data3=ColourSwatch(SwatchColor=RGB(255, 255, 0)))
mesh_curvature = MeshCurvature(Mesh=move_11.Geometry, CurvatureType=3, Radius=2, Method=list, Interval=Domain(0, 0), _3Colors=merge, On=True)  # -> Mesh, CurvatureValues

mesh_11 = Mesh([<mesh referenced from the Rhino model> x53])  # disabled
stripper_2 = Stripper(Mesh=move_3.Geometry)

stripper_3 = Stripper(Mesh=move_9.Geometry)
stripper_4 = Stripper(Mesh=move_5.Geometry)
stripper_5 = Stripper(Mesh=move_8.Geometry)
move_12 = Move(Geometry=stripper_2, Motion="0,1600,0")  # -> Geometry, Transform
move_13 = Move(Geometry=stripper_3, Motion="0,1600,0")  # -> Geometry, Transform
move_14 = Move(Geometry=stripper_4, Motion="0,1600,0")  # -> Geometry, Transform
move_15 = Move(Geometry=stripper_5, Motion="0,1600,0")  # -> Geometry, Transform
dispatch_2 = Dispatch(List=move_12.Geometry, DispatchPattern=[True, False])  # -> ListA, ListB
dispatch_3 = Dispatch(List=move_13.Geometry, DispatchPattern=[True, False])  # -> ListA, ListB
dispatch_4 = Dispatch(List=move_14.Geometry, DispatchPattern=[True, False])  # -> ListA, ListB
dispatch_5 = Dispatch(List=move_15.Geometry, DispatchPattern=[True, False])  # -> ListA, ListB
preview_3 = CustomPreview(Geometry=dispatch_3.ListB, Shader=ColourSwatch(SwatchColor=RGB(0, 0, 0)))
preview_4 = CustomPreview(Geometry=dispatch_3.ListA, Shader=ColourSwatch(SwatchColor=RGB(255, 255, 0)))
preview_5 = CustomPreview(Geometry=dispatch_4.ListB, Shader=ColourSwatch(SwatchColor=RGB(0, 0, 0)))
preview_6 = CustomPreview(Geometry=dispatch_5.ListB, Shader=ColourSwatch(SwatchColor=RGB(0, 0, 0)))
preview_7 = CustomPreview(Geometry=dispatch_4.ListA, Shader=ColourSwatch(SwatchColor=RGB(255, 255, 0)))
preview_8 = CustomPreview(Geometry=dispatch_5.ListA, Shader=ColourSwatch(SwatchColor=RGB(255, 255, 0)))

sort = SortList(Keys="0")  # -> Keys, ValuesA
mjoin_10 = MeshJoin(Meshes=mesh_11)  # disabled

swatch = ColourSwatch(SwatchColor=RGB(106, 255, 0))
swatch_2 = ColourSwatch(SwatchColor=RGB(255, 255, 0))
swatch_3 = ColourSwatch(SwatchColor=RGB(255, 0, 0))
panel_5 = Panel("0,1600,0")
move_16 = Move(Geometry=wbcatmullclark, Motion="0,800,0")  # -> Geometry, Transform
mesh_curvature_2 = MeshCurvature(Mesh=move_16.Geometry, CurvatureType=3, Radius=2, Method=1, Interval=Domain(0, 0), _3Colors=merge, On=True)  # -> Mesh, CurvatureValues

stripper_6 = Stripper(Mesh=move_6.Geometry)
stripper_7 = Stripper(Mesh=move_7.Geometry)
stripper_8 = Stripper(Mesh=move_4.Geometry)
stripper_9 = Stripper(Mesh=move_2.Geometry)

swatch_4 = ColourSwatch(SwatchColor=RGB(106, 255, 0))
swatch_5 = ColourSwatch(SwatchColor=RGB(255, 255, 0))
swatch_6 = ColourSwatch(SwatchColor=RGB(255, 0, 0))
move_17 = Move(Geometry=wbcatmullclark_3, Motion="0,1600,0")  # -> Geometry, Transform
mesh_curvature_3 = MeshCurvature(Mesh=move_17.Geometry, CurvatureType=3, Radius=2, Method=1, Interval=Domain(0, 0), _3Colors=merge, On=True)  # -> Mesh, CurvatureValues

move_18 = Move(Geometry=stripper_6, Motion="0,1600,0")  # -> Geometry, Transform
weldvertices_10 = MeshWeldVertices(Mesh=mjoin_10, Tolerance=0.01)  # -> RuntimeMessage, Mesh; disabled
move_19 = Move(Geometry=stripper_7, Motion="0,1600,0")  # -> Geometry, Transform
move_20 = Move(Geometry=stripper_8, Motion="0,1600,0")  # -> Geometry, Transform
move_21 = Move(Geometry=stripper_9, Motion="0,1600,0")  # -> Geometry, Transform

preview_9 = CustomPreview(Geometry=dispatch_2.ListB, Shader=ColourSwatch(SwatchColor=RGB(0, 0, 0)))
preview_10 = CustomPreview(Geometry=dispatch_2.ListA, Shader=ColourSwatch(SwatchColor=RGB(255, 255, 0)))

dispatch_6 = Dispatch(List=move_18.Geometry, DispatchPattern=[True, False])  # -> ListA, ListB
dispatch_7 = Dispatch(List=move_19.Geometry, DispatchPattern=[True, False])  # -> ListA, ListB
dispatch_8 = Dispatch(List=move_20.Geometry, DispatchPattern=[True, False])  # -> ListA, ListB
panel_6 = Panel(sort.Keys)
weldvertices_11 = MeshWeldVertices(Mesh=mjoin_10, Tolerance=0.01)  # -> RuntimeMessage, Mesh; disabled
dispatch_9 = Dispatch(List=move_21.Geometry, DispatchPattern=[True, False])  # -> ListA, ListB

swatch_7 = ColourSwatch(SwatchColor=RGB(106, 255, 0))
swatch_8 = ColourSwatch(SwatchColor=RGB(255, 255, 0))
swatch_9 = ColourSwatch(SwatchColor=RGB(255, 0, 0))
panel_7 = Panel("0,800,0")
move_22 = Move(Geometry=wbcatmullclark_8, Motion=panel_7)  # -> Geometry, Transform
mesh_curvature_4 = MeshCurvature(Mesh=move_22.Geometry, CurvatureType=3, Radius=2, Method=1, Interval=Domain(0, 0), _3Colors=merge, On=True)  # -> Mesh, CurvatureValues

preview_11 = CustomPreview(Geometry=dispatch_6.ListB, Shader=ColourSwatch(SwatchColor=RGB(0, 0, 0)))
preview_12 = CustomPreview(Geometry=dispatch_6.ListA, Shader=ColourSwatch(SwatchColor=RGB(255, 255, 0)))
preview_13 = CustomPreview(Geometry=dispatch_7.ListB, Shader=ColourSwatch(SwatchColor=RGB(0, 0, 0)))
preview_14 = CustomPreview(Geometry=dispatch_8.ListA, Shader=ColourSwatch(SwatchColor=RGB(255, 255, 0)))
preview_15 = CustomPreview(Geometry=dispatch_8.ListB, Shader=ColourSwatch(SwatchColor=RGB(0, 0, 0)))
preview_16 = CustomPreview(Geometry=dispatch_7.ListA, Shader=ColourSwatch(SwatchColor=RGB(255, 255, 0)))

swatch_10 = ColourSwatch(SwatchColor=RGB(106, 255, 0))
swatch_11 = ColourSwatch(SwatchColor=RGB(255, 255, 0))
swatch_12 = ColourSwatch(SwatchColor=RGB(255, 0, 0))
move_23 = Move(Geometry=wbcatmullclark_5, Motion="0,800,0")  # -> Geometry, Transform
mesh_curvature_5 = MeshCurvature(Mesh=move_5.Geometry, CurvatureType=3, Radius=2, Method=1, Interval=Domain(0, 0), _3Colors=merge, On=True)  # -> Mesh, CurvatureValues

preview_17 = CustomPreview(Geometry=dispatch_9.ListB, Shader=ColourSwatch(SwatchColor=RGB(0, 0, 0)))
preview_18 = CustomPreview(Geometry=dispatch_9.ListA, Shader=ColourSwatch(SwatchColor=RGB(255, 255, 0)))
demesh = DeconstructMesh(Mesh=weldvertices_10.Mesh)  # -> Vertices, Faces, Colours, Normals; disabled
mesh_12 = Mesh(weldvertices_10.Mesh)  # disabled

swatch_13 = ColourSwatch(SwatchColor=RGB(106, 255, 0))
swatch_14 = ColourSwatch(SwatchColor=RGB(255, 255, 0))
swatch_15 = ColourSwatch(SwatchColor=RGB(255, 0, 0))
move_24 = Move(Geometry=move_2.Geometry, Motion="0,00,0")  # -> Geometry, Transform
mesh_curvature_6 = MeshCurvature(Mesh=move_24.Geometry, CurvatureType=3, Radius=2, Method=1, Interval=Domain(0, 0), _3Colors=merge, On=True)  # -> Mesh, CurvatureValues

swatch_16 = ColourSwatch(SwatchColor=RGB(106, 255, 0))
swatch_17 = ColourSwatch(SwatchColor=RGB(255, 255, 0))
swatch_18 = ColourSwatch(SwatchColor=RGB(255, 0, 0))
mesh_curvature_7 = MeshCurvature(Mesh=move_5.Geometry, CurvatureType=3, Radius=2, Method=1, Interval=Domain(0, 0), _3Colors=merge, On=True)  # -> Mesh, CurvatureValues
move_25 = Move(Geometry=wbcatmullclark_9, Motion="0,1600,0")  # -> Geometry, Transform

number_slider_3 = Slider(22, range=0..100)  # disabled

swatch_19 = ColourSwatch(SwatchColor=RGB(106, 255, 0))
swatch_20 = ColourSwatch(SwatchColor=RGB(255, 255, 0))
swatch_21 = ColourSwatch(SwatchColor=RGB(255, 0, 0))
move_26 = Move(Geometry=wbcatmullclark_4, Motion="0,1600,0")  # -> Geometry, Transform
mesh_curvature_8 = MeshCurvature(Mesh=move_26.Geometry, CurvatureType=3, Radius=2, Method=1, Interval=Domain(0, 0), _3Colors=merge, On=True)  # -> Mesh, CurvatureValues

panel_8 = Panel("fdasfdsa")
number_slider_4 = Slider(1, range=0..10)  # disabled
facen = FaceNormals(Mesh=weldvertices_11.Mesh)  # -> Centers, Normals; disabled

swatch_22 = ColourSwatch(SwatchColor=RGB(106, 255, 0))
swatch_23 = ColourSwatch(SwatchColor=RGB(255, 255, 0))
swatch_24 = ColourSwatch(SwatchColor=RGB(255, 0, 0))
move_27 = Move(Geometry=wbcatmullclark_6, Motion="0,1600,0")  # -> Geometry, Transform
mesh_curvature_9 = MeshCurvature(Mesh=move_27.Geometry, CurvatureType=3, Radius=2, Method=1, Interval=Domain(0, 0), _3Colors=merge, On=True)  # -> Mesh, CurvatureValues

explode = MeshExplode(Mesh=mesh_12, Interpolate=False)  # disabled
explode_2 = MeshExplode(Mesh=weldvertices_10.Mesh, Interpolate=False)  # disabled
swatch_25 = ColourSwatch(SwatchColor=RGB(0, 132, 255))  # disabled
number_slider_5 = Slider(10, range=0..10)  # disabled
demesh_2 = DeconstructMesh(Mesh=explode_2)  # -> Vertices, Faces, Colours, Normals; disabled
points = PointList(Points=[facen.Centers, swatch_25], Size=[number_slider_3, swatch_25])  # disabled
item = ListItem(List=explode, Index=number_slider_4, Wrap=True)  # disabled
panel_9 = Panel("""0
1
2""")  # disabled

swatch_26 = ColourSwatch(SwatchColor=RGB(106, 255, 0))
swatch_27 = ColourSwatch(SwatchColor=RGB(255, 255, 0))
swatch_28 = ColourSwatch(SwatchColor=RGB(255, 0, 0))
move_28 = Move(Geometry=wbcatmullclark_7, Motion="0,1600,0")  # -> Geometry, Transform
mesh_curvature_10 = MeshCurvature(Mesh=move_28.Geometry, CurvatureType=3, Radius=2, Method=1, Interval=Domain(0, 0), _3Colors=merge, On=True)  # -> Mesh, CurvatureValues

panel_10 = Panel("""0
2
3""")  # disabled
demesh_3 = DeconstructMesh(Mesh=item)  # -> Vertices, Faces, Colours, Normals; disabled
points_2 = PointList(Points=demesh_2.Vertices, Size=number_slider_5)  # disabled
panel_11 = Panel(mjoin_8)
item_2 = ListItem(List=demesh_3.Vertices, Index=panel_9, Wrap=True)  # disabled
item_3 = ListItem(List=demesh_3.Vertices, Index=panel_10, Wrap=True)  # disabled
panel_12 = Panel("T{0;1;2}")  # disabled
stripper_10 = Stripper()  # disabled
conmesh = ConstructMesh(Vertices=item_2, Faces=panel_12)  # disabled
conmesh_2 = ConstructMesh(Vertices=item_3, Faces=panel_12)  # disabled
cull_i = CullIndex(List=explode, Indices=number_slider_4, Wrap=True)  # disabled
mesh_13 = Mesh(stripper_10)  # disabled
merge_2 = Merge(Data1=cull_i, Data2=conmesh, Data3=conmesh_2)  # disabled
lng = ListLength(List=mesh_13)  # disabled
panel_13 = Panel("""0
1
2
3
7
8
9
10
22
23
24
25""")  # disabled
number_slider_6 = Slider(1, range=0..2)  # disabled
# different topology
mesh_14 = Mesh([<mesh referenced from the Rhino model> x98])
mjoin_11 = MeshJoin(Meshes=merge_2)  # disabled
wheel = ColourWheel(
    lng,
    ColourGrips_Style=31,
    ColourGrips_Grip=[0, 2.094395102, 4.188790205, 3.141592654],
    ColourGrips_Lum=[0.1, 0.5],
    ColourGrips_Range=[0.2617993878, 0.2617993878, 0.2617993878, 0.2617993878],
    ColourGrips_Sat=[0.2, 0.6])  # disabled
panel_14 = Panel("2")  # disabled
mjoin_12 = MeshJoin(Meshes=mesh_14)
weldvertices_12 = MeshWeldVertices(Mesh=mjoin_11, Tolerance=0.01)  # -> RuntimeMessage, Mesh; disabled
mesh_15 = Mesh([<mesh referenced from the Rhino model> x53])  # disabled
weldvertices_13 = MeshWeldVertices(Mesh=mjoin_12, Tolerance=0.01)  # -> RuntimeMessage, Mesh
wbcatmullclark_10 = WeaverbirdsCatmullClarkSubdivision(MeshCurves=weldvertices_13.Mesh, Level="3", SmoothNakedEdges=number_slider_2)
wbcatmullclark_11 = WeaverbirdsCatmullClarkSubdivision(MeshCurves=weldvertices_12.Mesh, Level=panel_14, SmoothNakedEdges=number_slider_6)  # disabled
panel_15 = Panel("0,800,0")  # disabled
move_29 = Move(Geometry=wbcatmullclark_10, Motion="0,1200,0")  # -> Geometry, Transform
number_slider_7 = Slider(1, range=0..2)  # disabled
mjoin_13 = MeshJoin(Meshes=mesh_15)  # disabled
move_30 = Move(Geometry=wbcatmullclark_11, Motion=panel_15)  # -> Geometry, Transform; disabled
weldvertices_14 = MeshWeldVertices(Mesh=mjoin_13, Tolerance=0.01)  # -> RuntimeMessage, Mesh; disabled
explode_3 = MeshExplode(Mesh=weldvertices_14.Mesh, Interpolate=False)  # disabled
item_4 = ListItem(List=explode_3, Index=panel_13, Wrap=True)  # disabled
cull_i_2 = CullIndex(List=explode_3, Indices=panel_13, Wrap=True)  # disabled
demesh_4 = DeconstructMesh(Mesh=item_4)  # -> Vertices, Faces, Colours, Normals; disabled
shift = ShiftList(List=demesh_4.Vertices, Shift=number_slider_7, Wrap=True)  # disabled

# ----
# different topology
mesh_16 = Mesh([<mesh referenced from the Rhino model> x192])
mjoin_14 = MeshJoin(Meshes=mesh_16)
weldvertices_15 = MeshWeldVertices(Mesh=mjoin_14, Tolerance=0.01)  # -> RuntimeMessage, Mesh
wbcatmullclark_12 = WeaverbirdsCatmullClarkSubdivision(MeshCurves=weldvertices_15.Mesh, Level="3", SmoothNakedEdges=number_slider_2)
move_31 = Move(Geometry=wbcatmullclark_12, Motion="0,1200,0")  # -> Geometry, Transform

merge_3 = Merge(
    Data1=ColourSwatch(SwatchColor=RGB(255, 0, 0)),
    Data2=ColourSwatch(SwatchColor=RGB(255, 255, 0)),
    Data3=ColourSwatch(SwatchColor=RGB(106, 255, 0)))
move_32 = Move(Geometry=wbcatmullclark_12, Motion="0,1200,0")  # -> Geometry, Transform
mesh_curvature_11 = MeshCurvature(Mesh=move_32.Geometry, CurvatureType=3, Radius=2, Method=1, Interval=Domain(0, 0), _3Colors=merge, On=True)  # -> Mesh, CurvatureValues

number_slider_8 = Slider(1, range=0..2)  # disabled
panel_16 = Panel("""111
109
104
112
108
103
88
89""")
panel_17 = Panel("2")  # disabled
conmesh_3 = ConstructMesh(Vertices=shift, Faces=demesh_4.Faces)  # disabled
mesh_17 = Mesh(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)  # disabled

move_33 = Move(Geometry=weldvertices_3.Mesh, Motion="0,3200,0")  # -> Geometry, Transform
panel_18 = Panel("""28
20
27
22
10
13
5
18
19
4
0""")
facen_2 = FaceNormals(Mesh=move_33.Geometry)  # -> Centers, Normals
explode_4 = MeshExplode(Mesh=move_33.Geometry, Interpolate=False)
cull_i_3 = CullIndex(List=explode_4, Indices=panel_18, Wrap=True)
item_5 = ListItem(List=explode_4, Index=panel_18, Wrap=True)
points_3 = PointList(Points=facen_2.Centers, Size=Slider(10, range=0..10))
turn = MeshTurn(Mesh=item_5)
merge_4 = Merge(Data1=simplify(cull_i_3), Data2=simplify(turn))
mjoin_15 = MeshJoin(Meshes=flatten(merge_4))
weldvertices_16 = MeshWeldVertices(Mesh=mjoin_15, Tolerance=0.01)  # -> RuntimeMessage, Mesh
wbcatmullclark_13 = WeaverbirdsCatmullClarkSubdivision(MeshCurves=weldvertices_16.Mesh, Level="3", SmoothNakedEdges=number_slider_2)
stripper_11 = Stripper(Mesh=wbcatmullclark_13)
move_34 = Move(Geometry=stripper_11, Motion="0,6400,0")  # -> Geometry, Transform
dispatch_10 = Dispatch(List=move_34.Geometry, DispatchPattern=[True, False])  # -> ListA, ListB
preview_19 = CustomPreview(Geometry=dispatch_10.ListB, Shader=ColourSwatch(SwatchColor=RGB(0, 0, 0)))
preview_20 = CustomPreview(Geometry=dispatch_10.ListA, Shader=ColourSwatch(SwatchColor=RGB(255, 255, 0)))

lng_2 = ListLength(List=move_34.Geometry)
number_slider_9 = Slider(0.2, range=0..1)  # disabled
facen_3 = FaceNormals(Mesh=weldvertices_14.Mesh)  # -> Centers, Normals; disabled
explode_5 = MeshExplode(Mesh=mesh_17, Interpolate=False)  # disabled
number_slider_10 = Slider(22, range=0..23)  # disabled
merge_5 = Merge(Data1=cull_i_2, Data2=conmesh_3)  # disabled
wbedges = WeaverbirdsMeshEdges(MeshOrPolylines=graft(explode_5))  # disabled
wbcatmullclark_14 = WeaverbirdsCatmullClarkSubdivision(MeshCurves=explode_3, Level=panel_17, SmoothNakedEdges=number_slider_8)  # disabled
eval = EvaluateCurve(Curve=reparameterize(wbedges), Parameter=number_slider_9)  # -> Point, Tangent, Angle; disabled
eval_2 = EvaluateCurve(Curve=reparameterize(wbedges), Parameter=expr("1-x", number_slider_9))  # -> Point, Tangent, Angle; disabled
panel_20 = Panel("0,1500,0")  # disabled
points_4 = PointList(Points=facen_3.Centers, Size=number_slider_10)  # disabled
item_6 = ListItem(List=eval.Point, Index=0, Wrap=True)  # -> Item, Item1, Item2, Item3; disabled
item_7 = ListItem(List=eval_2.Point, Index=0, Wrap=True)  # -> Item, Item1, Item2, Item3; disabled

move_35 = Move(Geometry=weldvertices_15.Mesh, Motion="0,000,0")  # -> Geometry, Transform
facen_4 = FaceNormals(Mesh=move_35.Geometry)  # -> Centers, Normals
points_5 = PointList(Points=facen_4.Centers, Size=Slider(13.6, range=0..20))

explode_6 = MeshExplode(Mesh=move_35.Geometry, Interpolate=False)
item_8 = ListItem(List=explode_6, Index="1", Wrap=True)
turn_2 = MeshTurn(Mesh=item_8)
cull_i_4 = CullIndex(List=explode_6, Indices="1", Wrap=True)
merge_6 = Merge(Data1=simplify(cull_i_4), Data2=simplify(turn_2))
mjoin_16 = MeshJoin(Meshes=flatten(merge_6))
weldvertices_17 = MeshWeldVertices(Mesh=mjoin_16, Tolerance=0.01)  # -> RuntimeMessage, Mesh
wbcatmullclark_15 = WeaverbirdsCatmullClarkSubdivision(MeshCurves=weldvertices_17.Mesh, Level="3", SmoothNakedEdges=number_slider_2)
stripper_12 = Stripper(Mesh=wbcatmullclark_15)
move_36 = Move(Geometry=stripper_12, Motion="0,1200,0")  # -> Geometry, Transform
dispatch_11 = Dispatch(List=move_36.Geometry, DispatchPattern=[True, False])  # -> ListA, ListB
preview_21 = CustomPreview(Geometry=dispatch_11.ListB, Shader=ColourSwatch(SwatchColor=RGB(0, 0, 0)))
preview_22 = CustomPreview(Geometry=dispatch_11.ListA, Shader=ColourSwatch(SwatchColor=RGB(255, 255, 0)))

move_37 = Move(Geometry=wbcatmullclark_14, Motion=panel_20)  # -> Geometry, Transform; disabled
merge_7 = Merge(Data1=item_6.Item, Data2=item_7.Item2, Data3=item_6.Item2, Data4=item_7.Item)  # disabled
merge_8 = Merge(Data1=item_6.Item1, Data2=item_6.Item3, Data3=item_7.Item3, Data4=item_7.Item1)  # disabled

move_38 = Move(Geometry=weldvertices_13.Mesh, Motion="0,2400,0")  # -> Geometry, Transform
panel_21 = Panel("""111
115
79
75
80""")
facen_5 = FaceNormals(Mesh=move_38.Geometry)  # -> Centers, Normals
explode_7 = MeshExplode(Mesh=move_38.Geometry, Interpolate=False)
cull_i_5 = CullIndex(List=explode_7, Indices=panel_21, Wrap=True)
item_9 = ListItem(List=explode_7, Index=panel_21, Wrap=True)
points_6 = PointList(Points=facen_5.Centers, Size=Slider(10, range=0..10))
turn_3 = MeshTurn(Mesh=item_9)
merge_9 = Merge(Data1=simplify(cull_i_5), Data2=simplify(turn_3))
mjoin_17 = MeshJoin(Meshes=flatten(merge_9))
weldvertices_18 = MeshWeldVertices(Mesh=mjoin_17, Tolerance=0.01)  # -> RuntimeMessage, Mesh
wbcatmullclark_16 = WeaverbirdsCatmullClarkSubdivision(MeshCurves=weldvertices_18.Mesh, Level="3", SmoothNakedEdges=number_slider_2)
stripper_13 = Stripper(Mesh=wbcatmullclark_16)
move_39 = Move(Geometry=stripper_13, Motion="0,1200,0")  # -> Geometry, Transform
dispatch_12 = Dispatch(List=move_39.Geometry, DispatchPattern=[True, False])  # -> ListA, ListB
preview_23 = CustomPreview(Geometry=dispatch_12.ListB, Shader=ColourSwatch(SwatchColor=RGB(0, 0, 0)))
preview_24 = CustomPreview(Geometry=dispatch_12.ListA, Shader=ColourSwatch(SwatchColor=RGB(255, 255, 0)))

preview_25 = CustomPreview(Geometry=move_35.Geometry, Material=ColourSwatch(SwatchColor=RGBA(255, 255, 255, 167)))
conmesh_4 = ConstructMesh(Vertices=merge_7, Faces={A=0, B=1, C=2, D=3})  # disabled
conmesh_5 = ConstructMesh(Vertices=merge_8, Faces={A=0, B=1, C=2, D=3})  # disabled
sort_2 = SortList(Keys="1")  # -> Keys, ValuesA
merge_10 = Merge(Data1=conmesh_4, Data2=conmesh_5)  # -> flatten(Result); disabled
lng_3 = ListLength(List=facen_4.Centers)
mjoin_18 = MeshJoin(Meshes=merge_10)  # disabled
weldvertices_19 = MeshWeldVertices(Mesh=mjoin_18, Tolerance=0.01)  # -> RuntimeMessage, Mesh; disabled
panel_22 = Panel(lng_3)
panel_23 = Panel(sort_2.Keys)
disjoint = DisjointMesh(Mesh=weldvertices_19.Mesh)  # disabled
turn_4 = MeshTurn(Mesh=merge_6)  # disabled
swatch_29 = ColourSwatch(SwatchColor=RGB(255, 255, 255))
move_40 = Move(Geometry=merge_6, Motion="0,000,0")  # -> Geometry, Transform

move_41 = Move(Geometry=weldvertices_13.Mesh, Motion="0,3200,0")  # -> Geometry, Transform
facen_6 = FaceNormals(Mesh=move_41.Geometry)  # -> Centers, Normals
explode_8 = MeshExplode(Mesh=move_41.Geometry, Interpolate=False)
cull_i_6 = CullIndex(List=explode_8, Indices="1", Wrap=True)
item_10 = ListItem(List=explode_8, Index="1", Wrap=True)
points_7 = PointList(Points=facen_6.Centers, Size=Slider(10, range=0..10))
turn_5 = MeshTurn(Mesh=item_10)
merge_11 = Merge(Data1=simplify(cull_i_6), Data2=simplify(turn_5))
mjoin_19 = MeshJoin(Meshes=flatten(merge_11))
weldvertices_20 = MeshWeldVertices(Mesh=mjoin_19, Tolerance=0.01)  # -> RuntimeMessage, Mesh
wbcatmullclark_17 = WeaverbirdsCatmullClarkSubdivision(MeshCurves=weldvertices_20.Mesh, Level="3", SmoothNakedEdges=number_slider_2)
stripper_14 = Stripper(Mesh=wbcatmullclark_17)
move_42 = Move(Geometry=stripper_14, Motion="0,1600,0")  # -> Geometry, Transform
dispatch_13 = Dispatch(List=move_42.Geometry, DispatchPattern=[True, False])  # -> ListA, ListB
preview_26 = CustomPreview(Geometry=dispatch_13.ListB, Shader=ColourSwatch(SwatchColor=RGB(0, 0, 0)))
preview_27 = CustomPreview(Geometry=dispatch_13.ListA, Shader=ColourSwatch(SwatchColor=RGB(255, 255, 0)))

lng_4 = ListLength(List=move_42.Geometry)
mjoin_20 = MeshJoin(Meshes=flatten(move_40.Geometry))

explode_9 = MeshExplode(Mesh=explode_5, Interpolate=False)  # disabled
wbedges_2 = WeaverbirdsMeshEdges(MeshOrPolylines=graft(explode_9))  # disabled
curvepoint = PointOnCurve(wbedges_2, parameter=0.5)  # disabled
item_11 = ListItem(List=curvepoint, Index=0, Wrap=True)  # -> Item, Item1, Item2, Item3; disabled
ln = Line(StartPoint=item_11.Item1, EndPoint=item_11.Item3)  # disabled
ln_2 = Line(StartPoint=item_11.Item, EndPoint=item_11.Item2)  # disabled
merge_12 = Merge(Data1=flatten(ln_2), Data2=flatten(ln))  # disabled
join = JoinCurves(Curves=merge_12, Preserve=False)  # disabled
crv = Curve(join)  # disabled

weldvertices_21 = MeshWeldVertices(Mesh=mjoin_20, Tolerance=0.01)  # -> RuntimeMessage, Mesh
wbcatmullclark_18 = WeaverbirdsCatmullClarkSubdivision(MeshCurves=weldvertices_21.Mesh, Level="3", SmoothNakedEdges=number_slider_2)
stripper_15 = Stripper(Mesh=wbcatmullclark_18)
swatch_30 = ColourSwatch(SwatchColor=RGB(0, 0, 0))  # disabled
swatch_31 = ColourSwatch(SwatchColor=RGB(255, 255, 0))  # disabled
dispatch_14 = Dispatch(List=stripper_15, DispatchPattern=[True, False])  # -> ListA, ListB; disabled
preview_28 = CustomPreview(Geometry=dispatch_14.ListB, Shader=swatch_30)  # disabled
preview_29 = CustomPreview(Geometry=dispatch_14.ListA, Shader=swatch_31)  # disabled

swatch_32 = ColourSwatch(SwatchColor=RGB(64, 64, 64))  # disabled
preview_30 = CustomPreview(Geometry=crv, Shader=swatch_32)  # disabled

wbnaked = WeaverbirdsNakedBoundary(MeshClosedPolylines=explode_5)  # disabled
button = Button()  # disabled
panel_24 = Panel("Isocurves")  # disabled
swatch_33 = ColourSwatch(SwatchColor=RGB(64, 64, 64))  # disabled
bake = ObjectBake(
    BakeToggle=button,
    GeometryObjects=[crv, wbnaked],
    Layer=panel_24,
    ObjectName="GH_Obj",
    ObjectColor=swatch_33,
    LayerColor=swatch_33)  # disabled

lng_5 = ListLength(List=disjoint)  # disabled
wheel_2 = ColourWheel(
    lng_5,
    ColourGrips_Style=10,
    ColourGrips_Grip=[0.5983369687, 0.2112191526, 4.261492372, 1.782015479],
    ColourGrips_Lum=[0.5185938584, 0.2520218182],
    ColourGrips_Range=[1.105076608, 1.105076608, 1.105076608, 1.105076608],
    ColourGrips_Sat=[0.4265346685, 1])  # disabled
swatch_34 = ColourSwatch(SwatchColor=RGB(156, 156, 156))  # disabled
mcol = MeshColours(Mesh=graft(disjoint), Colours=graft(wheel_2))  # disabled
swatch_35 = ColourSwatch(SwatchColor=RGBA(56, 56, 56, 0))  # disabled
preview_31 = CustomPreview(Geometry=mcol, Shader=swatch_35)  # disabled

dispatch_15 = Dispatch(List=disjoint, DispatchPattern=[True, False])  # -> ListA, ListB; disabled
swatch_36 = ColourSwatch(SwatchColor=RGB(255, 255, 255))  # disabled
swatch_37 = ColourSwatch(SwatchColor=RGB(56, 56, 56))  # disabled
preview_32 = CustomPreview(Geometry=dispatch_15.ListA, Shader=swatch_36)  # disabled
preview_33 = CustomPreview(Geometry=dispatch_15.ListB, Shader=swatch_37)  # disabled

# ---- group: bake
createatts = CreateAttributes(enableFullPath=False)  # disabled
toggle = BooleanToggle(False)  # disabled
bake_2 = BakeGeometry(Bake=toggle, Geometry=mcol, Attributes=createatts, DeleteOldBakes=False, PreserveTrees=False)  # disabled

# ----
panel_25 = Panel("""2
4
5
10
12
13
19
21
23
24
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""")
swatch_38 = ColourSwatch(SwatchColor=RGB(255, 255, 0))
swatch_39 = ColourSwatch(SwatchColor=RGB(3, 3, 3))

createatts_2 = CreateAttributes(Color=swatch_39, enableFullPath=False)
createatts_3 = CreateAttributes(Color=swatch_38, enableFullPath=False)
bake_3 = BakeGeometry(Bake=Toggle(False), Geometry=dispatch_11.ListB, Attributes=createatts_2, DeleteOldBakes=False, PreserveTrees=False)
bake_4 = BakeGeometry(Bake=Toggle(False), Geometry=dispatch_11.ListA, Attributes=createatts_3, DeleteOldBakes=False, PreserveTrees=False)

Z = UnitZ(Factor=1)

neg = Negative(Value=Z)

# ----
# different topology
panel_26 = Panel("3")
mjoin_21 = MeshJoin(Meshes=mesh)
weldvertices_22 = MeshWeldVertices(Mesh=mjoin_21, Tolerance=0.01)  # -> RuntimeMessage, Mesh

mesh_18 = Mesh([<mesh referenced from the Rhino model> x49])
mjoin_22 = MeshJoin(Meshes=mesh_18)
weldvertices_23 = MeshWeldVertices(Mesh=mjoin_22, Tolerance=0.01)  # -> RuntimeMessage, Mesh

wbcatmullclark_19 = WeaverbirdsCatmullClarkSubdivision(MeshCurves=weldvertices_23.Mesh, Level="3", SmoothNakedEdges=number_slider)

move_43 = Move(Geometry=wbcatmullclark_19, Motion="0,1600,0")  # -> Geometry, Transform

stripper_16 = Stripper(Mesh=move_43.Geometry)
move_44 = Move(Geometry=stripper_16, Motion="0,1600,0")  # -> Geometry, Transform
dispatch_16 = Dispatch(List=move_44.Geometry, DispatchPattern=[True, False])  # -> ListA, ListB
preview_34 = CustomPreview(Geometry=dispatch_16.ListB, Shader=ColourSwatch(SwatchColor=RGB(0, 0, 0)))
preview_35 = CustomPreview(Geometry=dispatch_16.ListA, Shader=ColourSwatch(SwatchColor=RGB(255, 255, 0)))

number_slider_11 = Slider(1e-05, range=0..1e-05)

# ---- group: KANGAROO
pt = Point([<point referenced from the Rhino model> x88])
mesh_19 = Mesh(weldvertices_22.Mesh)

# ----
demesh_5 = DeconstructMesh(Mesh=mesh_19)  # -> Vertices, Faces, Colours, Normals
load = Load(Point=demesh_5.Vertices, ForceVector=neg, Weighting=Slider(0.17, range=0..1))

edgelengths = EdgeLengths(Mesh=mesh_19, LengthFactor=Slider(0.9, range=0..1), Strength="10")

anchor = Anchor(Point=pt, Strength=10000)
show = Show(G=mesh_19)
merge_13 = Merge(Data2=load, Data3=edgelengths, Data4=anchor, Data5=show)  # -> flatten(Result)

zombiesolver = ZombieSolver(GoalObjects=merge_13, Threshold="0.0001", Tolerance=0.0001, MaxIterations=50000)  # -> I, V, O

# ---- group: KANGAROO (continued)
clean = CleanTree(RemoveNulls=True, RemoveInvalid=True, RemoveEmpty=False, Tree=zombiesolver.O)

# ----
wbcatmullclark_20 = WeaverbirdsCatmullClarkSubdivision(MeshCurves=clean, Level=panel_26, SmoothNakedEdges=number_slider_2)
move_45 = Move(Geometry=wbcatmullclark_20, Motion="0,1200,0")  # -> Geometry, Transform

move_46 = Move(Geometry=clean, Motion="0,1400,0")  # -> Geometry, Transform
facen_7 = FaceNormals(Mesh=move_46.Geometry)  # -> Centers, Normals
points_8 = PointList(Points=facen_7.Centers, Size=Slider(13.6, range=0..20))

preview_36 = CustomPreview(Geometry=move_46.Geometry, Material=ColourSwatch(SwatchColor=RGBA(255, 255, 255, 167)))

explode_10 = MeshExplode(Mesh=move_46.Geometry, Interpolate=False)
item_12 = ListItem(List=explode_10, Index="0", Wrap=True)
turn_6 = MeshTurn(Mesh=item_12)
cull_i_7 = CullIndex(List=explode_10, Indices="0", Wrap=True)
merge_14 = Merge(Data1=simplify(cull_i_7), Data2=simplify(turn_6))
mjoin_23 = MeshJoin(Meshes=flatten(merge_14))
weldvertices_24 = MeshWeldVertices(Mesh=mjoin_23, Tolerance=0.01)  # -> RuntimeMessage, Mesh
wbcatmullclark_21 = WeaverbirdsCatmullClarkSubdivision(MeshCurves=weldvertices_24.Mesh, Level="3", SmoothNakedEdges=number_slider_2)
stripper_17 = Stripper(Mesh=wbcatmullclark_21)
move_47 = Move(Geometry=stripper_17, Motion="0,6000,0")  # -> Geometry, Transform
dispatch_17 = Dispatch(List=move_47.Geometry, DispatchPattern=[True, False])  # -> ListA, ListB
preview_37 = CustomPreview(Geometry=dispatch_17.ListB, Shader=swatch_39)
preview_38 = CustomPreview(Geometry=dispatch_17.ListA, Shader=swatch_38)

item_13 = ListItem(List=explode_10, Index=Slider(91, range=0..168), Wrap=True)
lng_6 = ListLength(List=facen_7.Centers)
panel_27 = Panel(lng_6)

turn_7 = MeshTurn(Mesh=merge_14)
move_48 = Move(Geometry=turn_7, Motion="0,4800,0")  # -> Geometry, Transform
mjoin_24 = MeshJoin(Meshes=flatten(move_48.Geometry))
weldvertices_25 = MeshWeldVertices(Mesh=mjoin_24, Tolerance=0.01)  # -> RuntimeMessage, Mesh
wbcatmullclark_22 = WeaverbirdsCatmullClarkSubdivision(MeshCurves=weldvertices_25.Mesh, Level="3", SmoothNakedEdges=number_slider_2)
stripper_18 = Stripper(Mesh=wbcatmullclark_22)
dispatch_18 = Dispatch(List=stripper_18, DispatchPattern=[True, False])  # -> ListA, ListB
preview_39 = CustomPreview(Geometry=dispatch_18.ListB, Shader=ColourSwatch(SwatchColor=RGB(0, 0, 0)))
preview_40 = CustomPreview(Geometry=dispatch_18.ListA, Shader=ColourSwatch(SwatchColor=RGB(255, 255, 0)))

move_49 = Move(Geometry=weldvertices_9.Mesh, Motion="0,8000,0")  # -> Geometry, Transform
panel_28 = Panel("""1
7
13
15
11
4
5
9
42
43
47
48
51
49
22
25
35
34
29
30
18
19
23
24
54
52
16
17""")

move_50 = Move(Geometry=weldvertices_3.Mesh, Motion="0,8000,0")  # -> Geometry, Transform
panel_29 = Panel("""25
21
26
8
9
17
16
1
7
3
11
6
12
14
15
2""")
facen_8 = FaceNormals(Mesh=move_50.Geometry)  # -> Centers, Normals
explode_11 = MeshExplode(Mesh=move_50.Geometry, Interpolate=False)
cull_i_8 = CullIndex(List=explode_11, Indices=panel_29, Wrap=True)
item_14 = ListItem(List=explode_11, Index=panel_29, Wrap=True)
points_9 = PointList(Points=facen_8.Centers, Size=Slider(6.3, range=0..10))
turn_8 = MeshTurn(Mesh=item_14)
merge_15 = Merge(Data1=simplify(cull_i_8), Data2=simplify(turn_8))
mjoin_25 = MeshJoin(Meshes=flatten(merge_15))
weldvertices_26 = MeshWeldVertices(Mesh=mjoin_25, Tolerance=0.01)  # -> RuntimeMessage, Mesh
wbcatmullclark_23 = WeaverbirdsCatmullClarkSubdivision(MeshCurves=weldvertices_26.Mesh, Level="3", SmoothNakedEdges=number_slider_2)
stripper_19 = Stripper(Mesh=wbcatmullclark_23)
move_51 = Move(Geometry=stripper_19, Motion="0,800,0")  # -> Geometry, Transform
dispatch_19 = Dispatch(List=move_51.Geometry, DispatchPattern=[True, False])  # -> ListA, ListB
preview_41 = CustomPreview(Geometry=dispatch_19.ListB, Shader=ColourSwatch(SwatchColor=RGB(0, 0, 0)))
preview_42 = CustomPreview(Geometry=dispatch_19.ListA, Shader=ColourSwatch(SwatchColor=RGB(255, 255, 0)))

move_52 = Move(Geometry=move_49.Geometry, Motion="-150,0,0")  # -> Geometry, Transform

facen_9 = FaceNormals(Mesh=move_52.Geometry)  # -> Centers, Normals
explode_12 = MeshExplode(Mesh=move_52.Geometry, Interpolate=False)
cull_i_9 = CullIndex(List=explode_12, Indices=panel_28, Wrap=True)
item_15 = ListItem(List=explode_12, Index=panel_28, Wrap=True)
points_10 = PointList(Points=facen_9.Centers, Size=Slider(10, range=0..10))
turn_9 = MeshTurn(Mesh=item_15)
merge_16 = Merge(Data1=simplify(cull_i_9), Data2=simplify(turn_9))
mjoin_26 = MeshJoin(Meshes=flatten(merge_16))
weldvertices_27 = MeshWeldVertices(Mesh=mjoin_26, Tolerance=0.01)  # -> RuntimeMessage, Mesh
wbcatmullclark_24 = WeaverbirdsCatmullClarkSubdivision(MeshCurves=weldvertices_27.Mesh, Level="3", SmoothNakedEdges=number_slider_2)
stripper_20 = Stripper(Mesh=wbcatmullclark_24)
move_53 = Move(Geometry=stripper_20, Motion="0,800,0")  # -> Geometry, Transform
dispatch_20 = Dispatch(List=move_53.Geometry, DispatchPattern=[True, False])  # -> ListA, ListB
preview_43 = CustomPreview(Geometry=dispatch_20.ListB, Shader=ColourSwatch(SwatchColor=RGB(0, 0, 0)))
preview_44 = CustomPreview(Geometry=dispatch_20.ListA, Shader=ColourSwatch(SwatchColor=RGB(255, 255, 0)))

panel_30 = Panel("""19
4
5
10
2
1
8
6
7
14
21
20""")

move_54 = Move(Geometry=weldvertices_8.Mesh, Motion="300,00,0")  # -> Geometry, Transform

move_55 = Move(Geometry=move_54.Geometry, Motion="0,8000,0")  # -> Geometry, Transform
facen_10 = FaceNormals(Mesh=move_55.Geometry)  # -> Centers, Normals
explode_13 = MeshExplode(Mesh=move_55.Geometry, Interpolate=False)
cull_i_10 = CullIndex(List=explode_13, Indices=panel_30, Wrap=True)
item_16 = ListItem(List=explode_13, Index=panel_30, Wrap=True)
points_11 = PointList(Points=facen_10.Centers, Size=Slider(10, range=0..10))
turn_10 = MeshTurn(Mesh=item_16)
merge_17 = Merge(Data1=simplify(cull_i_10), Data2=simplify(turn_10))
mjoin_27 = MeshJoin(Meshes=flatten(merge_17))
weldvertices_28 = MeshWeldVertices(Mesh=mjoin_27, Tolerance=0.01)  # -> RuntimeMessage, Mesh
wbcatmullclark_25 = WeaverbirdsCatmullClarkSubdivision(MeshCurves=weldvertices_28.Mesh, Level="3", SmoothNakedEdges=number_slider_2)
stripper_21 = Stripper(Mesh=wbcatmullclark_25)
move_56 = Move(Geometry=stripper_21, Motion="0,800,0")  # -> Geometry, Transform
dispatch_21 = Dispatch(List=move_56.Geometry, DispatchPattern=[True, False])  # -> ListA, ListB
preview_45 = CustomPreview(Geometry=dispatch_21.ListA, Shader=ColourSwatch(SwatchColor=RGB(255, 255, 0)))
preview_46 = CustomPreview(Geometry=dispatch_21.ListB, Shader=ColourSwatch(SwatchColor=RGB(0, 0, 0)))
